# Dynamo graph Framing_Align_script.dyn (Dynamo 3.0.3.7597)
# author: daniil.timin@gmail.com

ui_python_2_req = Python()  # IronPython2; unwired: IN[0]
# ---------- ui_python_2_req.python (105 lines) ----------
import clr
import sys

# Add references to WPF and Revit API
clr.AddReference('PresentationCore')
clr.AddReference('PresentationFramework')
clr.AddReference('System.Windows.Forms')
clr.AddReference('RevitServices')
clr.AddReference('RevitAPI')
clr.AddReference('RevitAPIUI')

from System.Windows import Application, Window, Thickness
from System.Windows.Controls import Button, StackPanel
from Autodesk.Revit.DB import *
from Autodesk.Revit.UI import *
from RevitServices.Persistence import DocumentManager

# Get the current Revit document and UI document
doc = DocumentManager.Instance.CurrentDBDocument
uidoc = DocumentManager.Instance.CurrentUIApplication.ActiveUIDocument

# Initialize lists to store selected elements
first_selection = []
second_selection = []

# Define the WPF window
class ElementSelectionWindow(Window):
    def __init__(self):
        self.Title = "Select Elements"
        self.Width = 300
        self.Height = 150

        # Create a StackPanel to hold the buttons
        self.stack_panel = StackPanel()

        # Create the "Select First Set" button
        self.select_first_button = Button()
        self.select_first_button.Content = "Select beams to align"
        self.select_first_button.Margin = Thickness(10)
        self.select_first_button.Click += self.on_select_first_button_click  # Attach event handler

        # Create the "Select Single Element" button
        self.select_second_button = Button()
        self.select_second_button.Content = "Select the example beam"
        self.select_second_button.Margin = Thickness(10)
        self.select_second_button.Click += self.on_select_second_button_click  # Attach event handler

        # Add buttons to the StackPanel
        self.stack_panel.Children.Add(self.select_first_button)
        self.stack_panel.Children.Add(self.select_second_button)

        # Set the window content
        self.Content = self.stack_panel

    def on_select_first_button_click(self, sender, e):
        # Close the window before starting the selection process
        self.DialogResult = True
        self.Close()

    def on_select_second_button_click(self, sender, e):
        # Close the window before starting the selection process
        self.DialogResult = True
        self.Close()

# Function to handle element selection
def select_elements(prompt, allow_multiple=True):
    # After the window is closed, start the selection process
    try:
        if allow_multiple:
            # Prompt the user to select multiple elements
            sel = uidoc.Selection.PickObjects(Selection.ObjectType.Element, prompt)
            elements = [doc.GetElement(s.ElementId) for s in sel]
        else:
            # Prompt the user to select a single element
            sel = uidoc.Selection.PickObject(Selection.ObjectType.Element, prompt)
            elements = [doc.GetElement(sel.ElementId)]

        return elements

    except Exception as ex:
        # Handle any errors
        return "An error occurred: " + str(ex)

# Create and show the WPF window
window = ElementSelectionWindow()
window.ShowDialog()  # This blocks until the window is closed

# Determine which button was clicked
if window.DialogResult == True:
    # First selection: Multiple elements
    first_selection = select_elements("Select the first set of elements", allow_multiple=True)

    # Reopen the window for the second selection
    window = ElementSelectionWindow()
    window.ShowDialog()

    if window.DialogResult == True:
        # Second selection: Single element
        second_selection = select_elements("Select a single element", allow_multiple=False)

# Combine both selections into a single list
if isinstance(first_selection, list) and isinstance(second_selection, list):
    OUT = [first_selection, second_selection]
else:
    OUT = "Selection failed. Please try again."
# ----------------------------------------
code_block = CodeBlock(a=ui_python_2_req) { a[0]; }

# group: what to align
getLocation = Element.GetLocation(element=code_block)

code_block_2 = CodeBlock(a=ui_python_2_req) { a[1]; }

# group: target object
getLocation_2 = Element.GetLocation(element=code_block_2)

code_block_3 = CodeBlock(a=getLocation_2) { a[0]; }
ai_rocks = Python(IN[0]=getLocation, IN[1]=code_block_3)  # CPython3
# ---------- ai_rocks.python (77 lines) ----------
import clr
clr.AddReference('ProtoGeometry')
from Autodesk.DesignScript.Geometry import *

# Assign inputs from Dynamo
list1 = IN[0]  # List of Dynamo lines (beams) to align
target_line = IN[1]  # Target Dynamo line (beam) to match

def align_beams_to_target(list1, target_line):
    """
    Aligns a list of beams (Dynamo lines) to match the start and end points of a target beam (Dynamo line),
    while maintaining their spacing, parallelism, and Z-coordinate.

    :param list1: List of Dynamo lines (beams) to align.
    :param target_line: Target Dynamo line (beam) to match.
    :return: List of aligned Dynamo lines.
    """
    def is_horizontal(line):
        """Checks if a line is horizontal (Y coordinates of start and end points are the same)."""
        return abs(line.StartPoint.Y - line.EndPoint.Y) < 1e-6  # Tolerance for floating-point comparison

    def is_vertical(line):
        """Checks if a line is vertical (X coordinates of start and end points are the same)."""
        return abs(line.StartPoint.X - line.EndPoint.X) < 1e-6  # Tolerance for floating-point comparison

    def align_horizontal_beam(line, target_line):
        """Aligns a horizontal beam to the target beam by adjusting X coordinates."""
        # Get the start and end points of the target line
        target_start = target_line.StartPoint
        target_end = target_line.EndPoint

        # Calculate the new start and end points for the line
        new_start = Point.ByCoordinates(target_start.X, line.StartPoint.Y, line.StartPoint.Z)
        new_end = Point.ByCoordinates(target_end.X, line.EndPoint.Y, line.EndPoint.Z)

        # Create a new line with the aligned points
        return Line.ByStartPointEndPoint(new_start, new_end)

    def align_vertical_beam(line, target_line):
        """Aligns a vertical beam to the target beam by adjusting Y coordinates."""
        # Get the start and end points of the target line
        target_start = target_line.StartPoint
        target_end = target_line.EndPoint

        # Calculate the new start and end points for the line
        new_start = Point.ByCoordinates(line.StartPoint.X, target_start.Y, line.StartPoint.Z)
        new_end = Point.ByCoordinates(line.EndPoint.X, target_end.Y, line.EndPoint.Z)

        # Create a new line with the aligned points
        return Line.ByStartPointEndPoint(new_start, new_end)

    # Check if the target line is horizontal or vertical
    if is_horizontal(target_line):
        align_function = align_horizontal_beam
    elif is_vertical(target_line):
        align_function = align_vertical_beam
    else:
        raise ValueError("Target line is neither horizontal nor vertical.")

    # Align each beam in list1 to the target line
    aligned_beams = []
    for line in list1:
        try:
            # Align the beam to the target line
            aligned_beam = align_function(line, target_line)
            aligned_beams.append(aligned_beam)
        except Exception as ex:
            print(f"Skipping invalid line: {ex}")
            continue

    return aligned_beams

# Align the beams
aligned_beams = align_beams_to_target(list1, target_line)

# Output the aligned beams to Dynamo
OUT = aligned_beams
# ----------------------------------------
setLocation = Element.SetLocation(element=code_block, geometry=ai_rocks)

# group: remove start/end extensions
code_block_4 = CodeBlock { "Start Extension"; }
code_block_5 = CodeBlock { 0; }
setParameterByName = Element.SetParameterByName(element=code_block, parameterName=code_block_4, value=code_block_5)
code_block_6 = CodeBlock { "End Extension"; }
code_block_7 = CodeBlock { 0; }
setParameterByName_2 = Element.SetParameterByName(element=code_block, parameterName=code_block_6, value=code_block_7)
