# Dynamo graph Framing Disallow Structural  Joints_script.dyn "Framing Disallow Structural Joins" (Dynamo 2.16.1.2727)

selected_elements = Python()  # CPython3; unwired: IN[0]
# ---------- selected_elements.python (41 lines) ----------
import clr

clr.AddReference('RevitAPI')
import Autodesk
from Autodesk.Revit.DB import *

clr.AddReference('RevitServices')
import RevitServices
from RevitServices.Persistence import DocumentManager

doc = DocumentManager.Instance.CurrentDBDocument
uiapp = DocumentManager.Instance.CurrentUIApplication
app = uiapp.Application
uidoc = uiapp.ActiveUIDocument

clr.AddReference('RevitNodes')
import Revit
clr.ImportExtensions(Revit.Elements)

ueWrapper = None
wrappers = clr.GetClrType(Revit.Elements.ElementWrapper).GetMethods()
for w in wrappers:
	if w.ToString().startswith("Revit.Elements.UnknownElement"):
		ueWrapper = w
		break
		
out = []
selectElemId = uidoc.Selection.GetElementIds()
selectElem = [doc.GetElement(xId) for xId in selectElemId]

for i in selectElem:
	try:
		check = Revit.Elements.ElementWrapper.Wrap(i, True)
	except: check = None

	if check is None:
		out.append(ueWrapper.Invoke(None, (i, False)))
	else:
		out.append(i) 

OUT = out
# ----------------------------------------
disallow_joins = Python(IN[0]=selected_elements)  # CPython3
# ---------- disallow_joins.python (33 lines) ----------
import clr
clr.AddReference("RevitAPI")
import Autodesk
from Autodesk.Revit.DB import *
clr.AddReference("RevitServices")
import RevitServices
from RevitServices.Persistence import DocumentManager
from RevitServices.Transactions import TransactionManager
clr.AddReference("RevitNodes")
import Revit
clr.ImportExtensions(Revit.Elements)
#### End of General imports  ##### 
# Unwrap inputs
input = UnwrapElement( IN[0] )
elements = []
#force input into list
try:
    for e in input:
        if e.Category.Name == "Structural Framing":
            elements.append(e)
except:
    if input.Category.Name == "Structural Framing": 
        elements.append(input)
# Start Transaction
doc = DocumentManager.Instance.CurrentDBDocument
TransactionManager.Instance.EnsureInTransaction(doc)
for e in elements:
    Autodesk.Revit.DB.Structure.StructuralFramingUtils.DisallowJoinAtEnd(e, 0)
    Autodesk.Revit.DB.Structure.StructuralFramingUtils.DisallowJoinAtEnd(e, 1)
# End Transaction
TransactionManager.Instance.TransactionTaskDone()
# Wrap
OUT = elements
# ----------------------------------------
