# Dynamo graph Boundary_Create_txt_multi_script.dyn (Dynamo 2.17.0.3472)
# author: daniil.timin@gmail.com

selected_elements = Python()  # CPython3; unwired: IN[0]
# ---------- selected_elements.python (41 lines) ----------
import clr

clr.AddReference('RevitAPI')
import Autodesk
from Autodesk.Revit.DB import *

clr.AddReference('RevitServices')
import RevitServices
from RevitServices.Persistence import DocumentManager

doc = DocumentManager.Instance.CurrentDBDocument
uiapp = DocumentManager.Instance.CurrentUIApplication
app = uiapp.Application
uidoc = uiapp.ActiveUIDocument

clr.AddReference('RevitNodes')
import Revit
clr.ImportExtensions(Revit.Elements)

ueWrapper = None
wrappers = clr.GetClrType(Revit.Elements.ElementWrapper).GetMethods()
for w in wrappers:
	if w.ToString().startswith("Revit.Elements.UnknownElement"):
		ueWrapper = w
		break
		
out = []
selectElemId = uidoc.Selection.GetElementIds()
selectElem = [doc.GetElement(xId) for xId in selectElemId]

for i in selectElem:
	try:
		check = Revit.Elements.ElementWrapper.Wrap(i, True)
	except: check = None

	if check is None:
		out.append(ueWrapper.Invoke(None, (i, False)))
	else:
		out.append(i) 

OUT = out
# ----------------------------------------
pop_up_message = Python(IN[0]=selected_elements)  # IronPython2
# ---------- pop_up_message.python (16 lines) ----------
#This script pops up a dialog box with a message from the previous node.
import clr
clr.AddReference('RevitAPIUI')

from Autodesk.Revit.UI import TaskDialog
mainText = "Select Detail Lines first."

if IN[0] == []:
    messagePop = TaskDialog("Dynamo Player")
    messagePop.MainContent = mainText
    OUT = []
    messagePop.Show()

else:
    OUT = IN[0]
	
# ----------------------------------------
current = Document.Current()
activeView = Document.ActiveView(document=current)
code_block = CodeBlock { "DetailCurve"; }
input_check = Python(IN[0]=pop_up_message)  # CPython3
# ---------- input_check.python (8 lines) ----------
input = IN[0]
elements = []

if isinstance(input, list): 
	for i in input:	elements.append(i)
else: elements = [input]
		
OUT = elements
# ----------------------------------------
string_from_object = FromObject(object=input_check)
category_filter = Python(IN[0]=pop_up_message, IN[1]=code_block, IN[2]=string_from_object)  # CPython3
# ---------- category_filter.python (5 lines) ----------
outt = []
for i in range(len(IN[0])):
	if  IN[2][i] == IN[1]:
		outt.append(IN[0][i])
OUT = outt
# ----------------------------------------
input_check_2 = Python(IN[0]=category_filter)  # CPython3
# ---------- input_check_2.python (3 lines) ----------
if isinstance(IN[0], list):
	OUT = IN[0]
else: OUT = [IN[0],IN[0]]
# ----------------------------------------
curve = DetailCurve.Curve(detailCurve=input_check_2)
code_block_2 = CodeBlock { 2; }
pointsAtEqualSegmentLength = Curve.PointsAtEqualSegmentLength(curve=curve, divisions=code_block_2)
length = Curve.Length(curve=curve)
string = StringInput("m ")
startPoint = Curve.StartPoint(curve=curve)
X = Point.X(point=startPoint)
endPoint = Curve.EndPoint(curve=curve)
X_2 = Point.X(point=endPoint)
list_create = List.Create(item0=X, item1=X_2)
Y = Point.Y(point=startPoint)
Y_2 = Point.Y(point=endPoint)
list_create_2 = List.Create(item0=Y, item1=Y_2)

# group: tolerances
round_to_1 = CodeBlock { 59.9; }
round_to_0 = CodeBlock { 0.4; }

angle_text = Python(IN[0]=list_create, IN[1]=list_create_2, IN[2]=round_to_1, IN[3]=round_to_0)  # CPython3
# ---------- angle_text.python (50 lines) ----------
import math

from math import atan2,degrees

x = IN[0]
y = IN[1]
acc_max = IN[2]
acc_min = IN[3]

def AngleBtw2Points(pointA, pointB):
  changeInX = x[1][i] - x[0][i]
  changeInY = y[1][i] - y[0][i]
  return degrees(atan2(changeInY,changeInX)) #remove degrees if you want your answer in radians
d = []
for i in range(0, len(x[0])):
	d.append(AngleBtw2Points(x,y))


def dd_to_dms(degs):
    neg = degs < 0
    degs = (-1) ** neg * degs
    degs, d_int = math.modf(degs)
    mins, m_int = math.modf(60 * degs)
    secs        =           60 * mins
    
    if secs > acc_max:
    	secs = 0
    	m_int = m_int + 1
    
    if m_int > acc_max:
    	m_int = 0
    	d_int = d_int+1
  
    if secs < acc_min:
    	secs = 0
    
    if m_int < acc_min:
    	m_int = 0

    if d_int < acc_min:
    	d_int = 0
    	
    return neg, d_int, m_int, secs

ss = []
for i in range(0, len(x[0])):
	ss.append(dd_to_dms(d[i]))


OUT = ss
# ----------------------------------------
string_2 = StringInput("°")
string_3 = StringInput("'")
string_4 = StringInput("\"")
python_script = Python(IN[0]=length, IN[1]=string, IN[2]=angle_text, IN[3]=string_2, IN[4]=string_3, IN[5]=string_4)  # CPython3
# ---------- python_script.python (12 lines) ----------
import math

fff = []

for i in range(0,len(IN[0])):
	z = str(round(IN[0][i]/10)*10/1000)
	an = str(IN[2][i][1]).split(".")[0]
	an2 = str(IN[2][i][2]).split(".")[0]
	an3 = str(IN[2][i][3]).split(".")[0]
	fff.append(z + IN[1] + an + IN[3]+an2+IN[4]+an3+IN[5])

OUT = fff
# ----------------------------------------
code_block_3 = CodeBlock { "Center"; }

# group: FONT
code_block_4 = CodeBlock { "2.4 mm Arial Black Opaque"; }

byName = TextNoteType.ByName(name=code_block_4)
string_from_object_2 = FromObject(object=byName)
default = TextNoteType.Default()
pop_up_message_2 = Python(IN[0]=string_from_object_2, IN[1]=code_block_4, IN[2]=default, IN[3]=byName)  # IronPython2
# ---------- pop_up_message_2.python (17 lines) ----------
#This script pops up a dialog box with a message from the previous node.
import clr
clr.AddReference('RevitAPIUI')

from Autodesk.Revit.UI import TaskDialog
mainText = "No font called "+IN[1]+" found. Default font will be used. Edit the script to specify the required font." 

if IN[0] == "null":
    messagePop = TaskDialog("Dynamo Player")
    messagePop.MainContent = mainText
    OUT = IN[2]
    messagePop.Show()
  

else:
    OUT = IN[3]
	
# ----------------------------------------
angle = Python(IN[0]=list_create, IN[1]=list_create_2)  # CPython3
# ---------- angle.python (13 lines) ----------
from math import atan2,degrees
x = IN[0]
y = IN[1]

def AngleBtw2Points(pointA, pointB):
  changeInX = x[1][i] - x[0][i]
  changeInY = y[1][i] - y[0][i]
  return degrees(atan2(changeInY,changeInX)) #remove degrees if you want your answer in radians
d = []
for i in range(0, len(x[0])):
	d.append(AngleBtw2Points(x,y))

OUT = d
# ----------------------------------------
byLocation = TextNote.ByLocation(view=activeView, location=pointsAtEqualSegmentLength, text=python_script, alignment=code_block_3, type=pop_up_message_2, rotation=angle)
python_script_2 = Python(IN[0]=pop_up_message, IN[1]=byLocation)  # CPython3
# ---------- python_script_2.python (3 lines) ----------
if isinstance(IN[0], list):
	x = []
else: OUT = IN[1][0]
# ----------------------------------------
string_from_object_3 = FromObject(object=curve)
pop_up_message_3 = Python(IN[0]=string_from_object_3)  # IronPython2
# ---------- pop_up_message_3.python (16 lines) ----------
#This script pops up a dialog box with a message from the previous node.
import clr
clr.AddReference('RevitAPIUI')

from Autodesk.Revit.UI import TaskDialog
mainText = "No Detail Lines in the selection."

if IN[0] == "null":
    messagePop = TaskDialog("Dynamo Player")
    messagePop.MainContent = mainText
    OUT = "no revisions found"
    messagePop.Show()

else:
    OUT = IN[0]
	
# ----------------------------------------
