# Dynamo graph Family_DELETE_script.dyn "Family_DELETE" (Dynamo 2.16.1.2727)

selected_elements = Python()  # CPython3; unwired: IN[0]
# ---------- selected_elements.python (41 lines) ----------
import clr

clr.AddReference('RevitAPI')
import Autodesk
from Autodesk.Revit.DB import *

clr.AddReference('RevitServices')
import RevitServices
from RevitServices.Persistence import DocumentManager

doc = DocumentManager.Instance.CurrentDBDocument
uiapp = DocumentManager.Instance.CurrentUIApplication
app = uiapp.Application
uidoc = uiapp.ActiveUIDocument

clr.AddReference('RevitNodes')
import Revit
clr.ImportExtensions(Revit.Elements)

ueWrapper = None
wrappers = clr.GetClrType(Revit.Elements.ElementWrapper).GetMethods()
for w in wrappers:
	if w.ToString().startswith("Revit.Elements.UnknownElement"):
		ueWrapper = w
		break
		
out = []
selectElemId = uidoc.Selection.GetElementIds()
selectElem = [doc.GetElement(xId) for xId in selectElemId]

for i in selectElem:
	try:
		check = Revit.Elements.ElementWrapper.Wrap(i, True)
	except: check = None

	if check is None:
		out.append(ueWrapper.Invoke(None, (i, False)))
	else:
		out.append(i) 

OUT = out
# ----------------------------------------
get_type_family = Python(IN[0]=selected_elements)  # CPython3
# ---------- get_type_family.python (29 lines) ----------
import clr

clr.AddReference("RevitServices")
import RevitServices
from RevitServices.Persistence import DocumentManager
from RevitServices.Transactions import TransactionManager
doc =  DocumentManager.Instance.CurrentDBDocument
app = DocumentManager.Instance.CurrentUIApplication.Application

clr.AddReference("RevitAPI")
from Autodesk.Revit.DB import *


try:
    f = IN[0]
    
    x = []
    
    if isinstance(f, list): 
    	for i in f:
    		x.append(i.Type.Family)
    else: x.append(f.Type.Family)
    
    for i in x:
        i.Delete()
    
    OUT = x
except:
    OUT = "error"
# ----------------------------------------
