# Dynamo graph Purge_script.dyn (Dynamo 3.0.3.7597)

string = StringInput("Views")

# group: Delete sheets marked DO NOT DELETE
code_block = CodeBlock { "Sheets"; }
byName = Category.ByName(name=code_block)
all_elements_of_category = ElementsOfCategory(Category=byName)
sheetName = Sheet.SheetName(sheet=all_elements_of_category)
code_block_2 = CodeBlock { "(DO NOT DELETE)"; }
contains = String.Contains(string=sheetName, searchFor=code_block_2)
filterByBoolMask = List.FilterByBoolMask(list=all_elements_of_category, mask=contains)
watch = Watch(filterByBoolMask.in)
delete = Element.Delete(element=watch)

flow_pass = Python(IN[0]=string, IN[1]=delete)  # CPython3
# ---------- flow_pass.python (2 lines) ----------
if IN[1] or IN[1] == []:
	OUT = IN[0]
# ----------------------------------------
byName_2 = Category.ByName(name=flow_pass)
all_elements_of_category_2 = ElementsOfCategory(Category=byName_2)
string_from_object = FromObject(object=all_elements_of_category_2)
null_check = Python(IN[0]=string_from_object, IN[1]=all_elements_of_category_2)  # CPython3
# ---------- null_check.python (12 lines) ----------
strings = IN[0]
list = IN[1]

elements = []


for a,b in zip(strings, list):	
	if a != "null":
		elements.append(b)

		
OUT = elements
# ----------------------------------------
code_block_3 = CodeBlock { "View Name"; }
getParameterValueByName = Element.GetParameterValueByName(element=null_check, parameterName=code_block_3)

# group: views to exclude from purge
code_block_4 = CodeBlock()
# ---------- code_block_4.designscript (6 lines) ----------
[
"Template",
"3D",
"USER ATTENTION",
"TEMPLATE"
];
# ----------------------------------------
comparator_to_excl_str_str = Python(IN[0]=getParameterValueByName, IN[1]=code_block_4, IN[2]=null_check)  # "comparator to EXCL (str,str,element)"; CPython3
# ---------- comparator_to_excl_str_str.python (26 lines) ----------
x = IN[0]
y = IN[1]
z = IN[2]


#if you want to INCLUDE then swap jk.append(False) and jk.append(True)
jk = []
zf = []

for i in range(len(x)):
	for j in range(len(y)):
		if x[i].find(y[j])!=-1: 
			zf = True
	if zf == True:
		jk.append(False)
	else:
		jk.append(True)
	zf = []
	
ist = zip(z,jk)
kg = []
for i in ist:
	if i[1] ==True:
		kg.append(i[0])
	
OUT = kg
# ----------------------------------------

watch_2 = Watch(comparator_to_excl_str_str)

# group: check if a view is not on the sheet
code_block_5 = CodeBlock { "Sheet Number"; }
getParameterValueByName_2 = Element.GetParameterValueByName(element=watch_2, parameterName=code_block_5)
python = Python(IN[0]=getParameterValueByName_2)  # CPython3
# ---------- python.python (8 lines) ----------
data = IN[0]

ss = []
for i in data:
	if i!="": ss.append(i)
	else: ss.append("False")

OUT = ss
# ----------------------------------------
python_2 = Python(IN[0]=python)  # CPython3
# ---------- python_2.python (7 lines) ----------
data = IN[0]

ss = []
for i in data:
	if i!="---": ss.append(i)
	else: ss.append("False")
OUT = ss
# ----------------------------------------
python_script = Python(IN[0]=python_2)  # CPython3
# ---------- python_script.python (8 lines) ----------
data = IN[0]

ss = []
for i in data:
	if i is not None: ss.append(i)
	else: ss.append("False")	

OUT = ss
# ----------------------------------------
python_script_2 = Python(IN[0]=python_script)  # CPython3
# ---------- python_script_2.python (8 lines) ----------
data = IN[0]

ss = []
for i in data:
	if i!="False": ss.append(True)
	else: ss.append(False)	

OUT = ss
# ----------------------------------------
filterByBoolMask_2 = List.FilterByBoolMask(list=watch_2, mask=python_script_2)

isViewTemplate = View.IsViewTemplate(view=filterByBoolMask_2.out)
filterByBoolMask_3 = List.FilterByBoolMask(list=filterByBoolMask_2.out, mask=isViewTemplate)
watch_3 = Watch(filterByBoolMask_3.out)

# group: delete all the views not on sheets
delete_2 = Element.Delete(element=watch_3)

pop_up_message = Python()  # CPython3; unwired: IN[0]
# ---------- pop_up_message.python (22 lines) ----------
#This script pops up a dialog box with a message from the previous node.
import clr
clr.AddReference('RevitAPIUI')

from Autodesk.Revit.UI import TaskDialog

if IN[0] is not None:
    ff = []
    for i in IN[0]: ff.append(i + " \n")
    
    mainText = "DELETED LIST: \n " + ''.join(i for i in ff)
    
    
    if mainText != None and mainText != "null"  :
    	messagePop = TaskDialog("Dynamo Player")
    	messagePop.MainContent = mainText
    	
    	OUT = "Success!"
    	
    	messagePop.Show()
else:
    OUT = "no run"
# ----------------------------------------
comparator_to_incl_str_str = Python(IN[0]=getParameterValueByName, IN[1]=code_block_4, IN[2]=null_check)  # "comparator to INCL (str,str,element)"; CPython3
# ---------- comparator_to_incl_str_str.python (26 lines) ----------
x = IN[0]
y = IN[1]
z = IN[2]


#if you want to INCLUDE then swap jk.append(False) and jk.append(True)
jk = []
zf = []

for i in range(len(x)):
	for j in range(len(y)):
		if x[i].find(y[j])!=-1: 
			zf = True
	if zf == True:
		jk.append(True)
	else:
		jk.append(False)
	zf = []
	
ist = zip(z,jk)
kg = []
for i in ist:
	if i[1] ==True:
		kg.append(i[0])
	
OUT = kg
# ----------------------------------------
watch_4 = Watch(comparator_to_incl_str_str)

# group: get all elements from 3D Template view and delete them and the view afterwards
get_all_views_by_type = Python()  # CPython3; graph input
# ---------- get_all_views_by_type.python (95 lines) ----------
#Copyright(c) 2015, Konrad Sobon
# @arch_laboratory, http://archi-lab.net

import clr
clr.AddReference('ProtoGeometry')
from Autodesk.DesignScript.Geometry import *

# Import DocumentManager and TransactionManager
clr.AddReference("RevitServices")
import RevitServices
from RevitServices.Persistence import DocumentManager
from RevitServices.Transactions import TransactionManager

# Import RevitAPI
clr.AddReference("RevitAPI")
import Autodesk
from Autodesk.Revit.DB import *

doc = DocumentManager.Instance.CurrentDBDocument
uiapp = DocumentManager.Instance.CurrentUIApplication
app = uiapp.Application

from System.Collections.Generic import *

# Import ToDSType(bool) extension method
clr.AddReference("RevitNodes")
import Revit
clr.ImportExtensions(Revit.Elements)

#The inputs to this node will be stored as a list in the IN variable.
dataEnteringNode = IN

#collect all views in the model
collector = FilteredElementCollector(doc)
views = collector.OfClass(View).ToElements()

#sort views into separate lists based on view type
areaPlans, ceilingPlans, columnSchedules = [], [], []
costReport, details, draftingViews = [], [], []
drawingSheets, elevations, engineetingPlans = [], [], []
floorPlans, internal, legends, loadReports = [], [], [], []
panelSchedules, pressureLossReports, renderings = [], [], []
reports, schedules, sections, threeD = [], [], [], []
undefined, walkthrough = [], []
for i in views:
	if not i.IsTemplate:
		if i.ViewType == ViewType.AreaPlan:
			areaPlans.append(i.ToDSType(True))
		elif i.ViewType == ViewType.CeilingPlan:
			ceilingPlans.append(i.ToDSType(True))
		elif i.ViewType == ViewType.ColumnSchedule:
			columnSchedules.append(i.ToDSType(True))
		elif i.ViewType == ViewType.CostReport:
			costReport.append(i.ToDSType(True))
		elif i.ViewType == ViewType.Detail:
			details.append(i.ToDSType(True))
		elif i.ViewType == ViewType.DraftingView:
			draftingViews.append(i.ToDSType(True))
		elif i.ViewType == ViewType.DrawingSheet:
			drawingSheets.append(i.ToDSType(True))
		elif i.ViewType == ViewType.Elevation:
			elevations.append(i.ToDSType(True))
		elif i.ViewType == ViewType.EngineeringPlan:
			engineetingPlans.append(i.ToDSType(True))
		elif i.ViewType == ViewType.FloorPlan:
			floorPlans.append(i.ToDSType(True))
		elif i.ViewType == ViewType.Internal:
			internal.append(i.ToDSType(True))
		elif i.ViewType == ViewType.Legend:
			legends.append(i.ToDSType(True))
		elif i.ViewType == ViewType.LoadsReport:
			loadReports.append(i.ToDSType(True))
		elif i.ViewType == ViewType.PanelSchedule:
			panelSchedules.append(i.ToDSType(True))
		elif i.ViewType == ViewType.PresureLossReport:
			pressureLossReports.append(i.ToDSType(True))
		elif i.ViewType == ViewType.Rendering:
			renderings.append(i.ToDSType(True))
		elif i.ViewType == ViewType.Report:
			reports.append(i.ToDSType(True))
		elif i.ViewType == ViewType.Schedule:
			schedules.append(i.ToDSType(True))
		elif i.ViewType == ViewType.Section:
			sections.append(i.ToDSType(True))
		elif i.ViewType == ViewType.ThreeD:
			threeD.append(i.ToDSType(True))
		elif i.ViewType == ViewType.Undefined:
			undefined.append(i.ToDSType(True))
		elif i.ViewType == ViewType.Walkthrough:
			walkthrough.append(i.ToDSType(True))
		else:
			continue

#Assign your output to the OUT variable
OUT = threeD
# ----------------------------------------
string_from_object_2 = FromObject(object=get_all_views_by_type)
code_block_6 = CodeBlock { "AxonometricView(Name = 3D Template )"; }
contains_2 = List.Contains(list=string_from_object_2, item=code_block_6, lacing=Longest)
filterByBoolMask_4 = List.FilterByBoolMask(list=get_all_views_by_type, mask=contains_2)
get_curtrent_doc_name = Python()  # CPython3
# ---------- get_curtrent_doc_name.python (8 lines) ----------
import clr

clr.AddReference("RevitServices")

from RevitServices.Persistence import DocumentManager
doc = DocumentManager.Instance.CurrentDBDocument

OUT = doc
# ----------------------------------------
get_all_elements_from_view = Python(IN[0]=filterByBoolMask_4.in, IN[1]=get_curtrent_doc_name)  # CPython3
# ---------- get_all_elements_from_view.python (20 lines) ----------
# Load the Python Standard and DesignScript Libraries

import clr
clr.AddReference('RevitAPI')
clr.AddReference('RevitServices')

import Autodesk,RevitServices
from Autodesk.Revit.DB import *
from RevitServices.Persistence import DocumentManager

doc = IN[1]

zz = IN[0]
collector = []

for view in zz:
	
	collector.append(FilteredElementCollector(doc, ElementId(view.Id)).ToElements())

OUT = collector
# ----------------------------------------

# group: ignore the error, it works
delete_3 = Element.Delete(element=get_all_elements_from_view)
flow_pass_2 = Python(IN[0]=delete, IN[1]=filterByBoolMask_4.in, IN[2]=delete_3)  # CPython3
# ---------- flow_pass_2.python (2 lines) ----------
if IN[0] and IN[2]==[]:
	OUT = IN[1]
# ----------------------------------------
delete_4 = Element.Delete(element=flow_pass_2)

string_from_object_3 = FromObject(object=watch_3)
input_check = Python(IN[0]=string_from_object_3)  # CPython3
# ---------- input_check.python (8 lines) ----------
input = IN[0]
elements = []

if isinstance(input, list): 
	for i in input:	elements.append(i)
else: elements = [input]
		
OUT = elements
# ----------------------------------------
boolean = BoolSelector(true)
flow_pass_3 = Python(IN[0]=input_check, IN[1]=boolean)  # CPython3
# ---------- flow_pass_3.python (2 lines) ----------
if IN[0]:
	OUT = IN[1]
# ----------------------------------------

# group: run revit purge command
postable_purge = Python(IN[0]=flow_pass_3)  # CPython3
# ---------- postable_purge.python (28 lines) ----------
import clr
clr.AddReference('RevitAPI')
clr.AddReference('RevitAPIUI')
import Autodesk
from Autodesk.Revit.UI import RevitCommandId
from Autodesk.Revit.UI import UIApplication
from Autodesk.Revit.UI import ExternalCommandData
clr.AddReference('RevitServices')
import RevitServices
from RevitServices.Persistence import DocumentManager
from RevitServices.Transactions import TransactionManager

doc = DocumentManager.Instance.CurrentDBDocument
uiapp = DocumentManager.Instance.CurrentUIApplication

RunIt = IN[0] 

if RunIt ==  True:
	CmndID = RevitCommandId.LookupCommandId('ID_PURGE_UNUSED')
	CmId = CmndID.Id
	uiapp.PostCommand(CmndID)
	errorReport = 'Success'
else:
	errorReport = 'Set IN[0] to true'
	

#Assign your output to the OUT variable
OUT = errorReport
# ----------------------------------------

code_block_7 = CodeBlock { "not working due a bug; "; }
