# Dynamo graph Print_Last_Rev_script.dyn (Dynamo 3.0.3.7597)

# group: print revisions
current = Document.Current()
filePath = Document.FilePath(document=current)
export_folder = Python(IN[0]=filePath)  # CPython3
# ---------- export_folder.python (17 lines) ----------
import os

x = IN[0].split('\\')

line = []
y = x[:-1]
z = []
for i in y: 
	z.append(i+'\\')
line = (''.join(z))

newpath = line+'Export'

if not os.path.exists(newpath):
    os.makedirs(newpath)
    
OUT = newpath
# ----------------------------------------
watch = Watch(export_folder)
folder = Python(IN[0]=filePath)  # CPython3
# ---------- folder.python (7 lines) ----------
x = IN[0].split('\\')

f = x[len(x)-1:]

m = f[0].split(".")

OUT = m[0]
# ----------------------------------------
current_date = Python(IN[0]=folder)  # CPython3
# ---------- current_date.python (3 lines) ----------
from datetime import date
today = date.today()
OUT = IN[0] + ' ' +today.strftime("%d.%m.%y")
# ----------------------------------------
file_name = Python(IN[0]=watch, IN[1]=current_date)  # CPython3
# ---------- file_name.python (49 lines) ----------
import os

name = IN[0] + '\\' + IN[1] + ".pdf"

if os.path.exists(name) == False: 
	OUT = name
else:
	name = IN[0] + '\\' + IN[1] + " v2.pdf"
	if os.path.exists(name) == False: 
		OUT = name 
	else:
		name = IN[0] + '\\' + IN[1] + " v3.pdf"
		if os.path.exists(name) == False: 
			OUT = name
		else:
			name = IN[0] + '\\' + IN[1] + " v4.pdf"		
			if os.path.exists(name) == False: 
				OUT = name
			else:
				name = IN[0] + '\\' + IN[1] + " v5.pdf"
				if os.path.exists(name) == False: 
					OUT = name
				else:
					name = IN[0] + '\\' + IN[1] + " v6.pdf"
					if os.path.exists(name) == False: 
						OUT = name
					else:
						name = IN[0] + '\\' + IN[1] + " v7.pdf"		
						if os.path.exists(name) == False: 
							OUT = name
						else:
							name = IN[0] + '\\' + IN[1] + " v8.pdf"	
							if os.path.exists(name) == False: 
								OUT = name
							else:
								name = IN[0] + '\\' + IN[1] + " v9.pdf"		
								if os.path.exists(name) == False: 
									OUT = name
								else:
									name = IN[0] + '\\' + IN[1] + " v10.pdf"	
									if os.path.exists(name) == False: 
										OUT = name
									else:
										name = IN[0] + '\\' + IN[1] + " v11.pdf"	
										if os.path.exists(name) == False: 
											OUT = name
										else:
											name = IN[0] + '\\' + IN[1] + " v12.pdf"	
											OUT = name											
# ----------------------------------------
get_all_sheets = Python()  # CPython3; unwired: IN[0]
# ---------- get_all_sheets.python (25 lines) ----------
import clr

clr.AddReference('RevitAPI')
from Autodesk.Revit.DB import *
clr.AddReference("RevitNodes")
import Revit
clr.ImportExtensions(Revit.Elements)

clr.AddReference("RevitServices")
import RevitServices
from RevitServices.Persistence import DocumentManager
from RevitServices.Transactions import TransactionManager


doc = DocumentManager.Instance.CurrentDBDocument

#getting all the views required
#lv = FilteredElementCollector(doc).OfClass(ViewPlan).WhereElementIsNotElementType().ToElements()

#xx = FilteredElementCollector(doc).OfClass(ViewSection).WhereElementIsNotElementType().ToElements()
if 2>1:
    yy = FilteredElementCollector(doc).OfClass(ViewSheet).WhereElementIsNotElementType().ToElements()


OUT = yy
# ----------------------------------------
get_revisions_on_sheet = Python(IN[0]=get_all_sheets)  # CPython3
# ---------- get_revisions_on_sheet.python (28 lines) ----------
import clr

clr.AddReference('RevitAPI')
from Autodesk.Revit.DB import *
clr.AddReference("RevitNodes")
import Revit
clr.ImportExtensions(Revit.Elements)

clr.AddReference("RevitServices")
import RevitServices
from RevitServices.Persistence import DocumentManager
from RevitServices.Transactions import TransactionManager


doc = DocumentManager.Instance.CurrentDBDocument

yy = UnwrapElement(IN[0])
#yy = FilteredElementCollector(doc).OfClass(ViewSheet).WhereElementIsNotElementType().ToElements()

ff = []

for i in yy:
	ff.append(i.GetAllRevisionIds())
	
#elementid = []
#for i in ff: elementid.append(ElementId(i.Id))

OUT = ff
# ----------------------------------------
element_by_id = ElementById(Id=get_revisions_on_sheet)
revisionDate = Revision.RevisionDate(revision=element_by_id)
to_string_easily = Python(IN[0]=revisionDate)  # CPython3
# ---------- to_string_easily.python (11 lines) ----------
#Copyright(c) 2015, Konrad K Sobon
# @arch_laboratory, http://archi-lab.net

import clr
clr.AddReference('ProtoGeometry')
from Autodesk.DesignScript.Geometry import *
#The inputs to this node will be stored as a list in the IN variable.
inp = IN[0]


OUT = map(str,inp)
# ----------------------------------------
flatten = List.Flatten(list=revisionDate)
pop_up_message = Python(IN[0]=flatten)  # CPython3
# ---------- pop_up_message.python (16 lines) ----------
#This script pops up a dialog box with a message from the previous node.
import clr
clr.AddReference('RevitAPIUI')

from Autodesk.Revit.UI import TaskDialog
mainText = "No revisions found"

if IN[0] == []:
    messagePop = TaskDialog("Dynamo Player")
    messagePop.MainContent = mainText
    OUT = "no revisions found"
    messagePop.Show()

else:
    OUT = IN[0]
	
# ----------------------------------------
sorted_by_date = Python(IN[0]=pop_up_message)  # CPython3
# ---------- sorted_by_date.python (19 lines) ----------
k = list(set(IN[0]))
y = []

if len(IN[0][0])==8:
    for i in k:
       x = i[6:8]+i[3:5]+i[0:2]
       y.append(x)
    c = zip(y, k)
    f = sorted(c)

if len(IN[0][0])==10:
    for i in k:
       x = i[6:10]+i[3:5]+i[0:2]
       y.append(x)
    c = zip(y, k)
    f = sorted(c)

#strange way to get second element from every sublist
OUT = [element for _, element in f]
# ----------------------------------------
lastItem = List.LastItem(list=sorted_by_date)
contains = String.Contains(string=to_string_easily, searchFor=lastItem)
filterByBoolMask = List.FilterByBoolMask(list=get_all_sheets, mask=contains)
code_block = CodeBlock { "Appears In Sheet List"; }
parameterByName = Parameter.ParameterByName(element=get_all_sheets, name=code_block)
string_from_object = FromObject(object=parameterByName)
if_no_rev_print_all = Python(IN[0]=get_all_sheets, IN[1]=filterByBoolMask.in, IN[2]=string_from_object)  # CPython3
# ---------- if_no_rev_print_all.python (21 lines) ----------
aa = UnwrapElement(IN[0])
bb = UnwrapElement(IN[1])
cc = UnwrapElement(IN[2])

if bb == None:
	xx = []
	for i in range(len(aa)):
		if cc[i] == "Appears In Sheet List : Yes":
			xx.append(aa[i])
	#This script pops up a dialog box with a message from the previous node.
	
	import clr
	clr.AddReference('RevitAPIUI')
	from Autodesk.Revit.UI import TaskDialog
	messagePop = TaskDialog("Dynamo Player")
	messagePop.MainContent = "No revision found, print all sheets"
	messagePop.Show()
	
	OUT = xx
	
else: OUT = IN[1]
# ----------------------------------------
sorted = Python(IN[0]=if_no_rev_print_all)  # CPython3
# ---------- sorted.python (16 lines) ----------
import clr
clr.AddReference('ProtoGeometry')
from Autodesk.DesignScript.Geometry import *
#The inputs to this node will be stored as a list in the IN variable.
inp = IN[0]
zz = []
for i in inp: zz.append(i.SheetNumber)

zipped = zip(zz,inp)

sorted_zipped_lists = sorted(zipped)

#crazy way to get the second element fom any sublist
sorted_list1 = [element for _, element in sorted_zipped_lists]

OUT = sorted_list1
# ----------------------------------------
input_check = Python(IN[0]=sorted)  # CPython3
# ---------- input_check.python (8 lines) ----------
input = IN[0]
elements = []

if isinstance(input, list): 
	for i in input:	elements.append(i)
else: elements = [input]
		
OUT = elements
# ----------------------------------------
name_only = Python(IN[0]=file_name)  # CPython3
# ---------- name_only.python (8 lines) ----------
x = IN[0].split('\\')

f = x[len(x)-1:]

g = f[0].replace(".pdf","")


OUT = g
# ----------------------------------------
string = StringInput("C:\Program Files (x86)\Adobe\Acrobat DC\Acrobat\Acrobat.exe")
string_2 = StringInput("C:\Program Files (x86)\Adobe\Acrobat Reader DC\Reader\AcroRd32.exe")
string_3 = StringInput("C:\Program Files\Bluebeam Software\Bluebeam Revu\Revu\Revu.exe")
run = BoolSelector(false)

# group: add drawing index
string_from_object_2 = FromObject(object=get_all_sheets)
look_for_drawing_index = Python(IN[0]=string_from_object_2)  # CPython3
# ---------- look_for_drawing_index.python (9 lines) ----------
names = IN[0]
output = []
for i in names:
	if "DRAWING INDEX" in i:
		output.append(True)
	else:
		output.append(False)
		
OUT = output
# ----------------------------------------
filterByBoolMask_2 = List.FilterByBoolMask(list=get_all_sheets, mask=look_for_drawing_index)

list_create = List.Create(item0=filterByBoolMask_2.in, item1=input_check)
flatten_2 = List.Flatten(list=list_create)

# group (continued): print revisions
watch_2 = Watch(flatten_2)
pdf_print = Python(IN[0]=watch_2, IN[1]=name_only, IN[2]=watch)  # CPython3
# ---------- pdf_print.python (40 lines) ----------
#Sean Page, 2021
import clr


clr.AddReference('RevitAPI')
from Autodesk.Revit.DB import *

clr.AddReference('System')
from System.Collections.Generic import List

clr.AddReference('RevitNodes')
import Revit
clr.ImportExtensions(Revit.Elements)

clr.AddReference('RevitServices')
import RevitServices
from RevitServices.Persistence import DocumentManager

doc = DocumentManager.Instance.CurrentDBDocument

Sheets = UnwrapElement(IN[0])
Names = IN[1]
Folder = IN[2]
result = []

if 2>1:
    opts = PDFExportOptions()
    opts.Combine = True
    opts.ColorDepth = ColorDepthType.Color
    opts.ExportQuality = PDFExportQualityType.DPI600
    opts.PaperFormat = ExportPaperFormat.Default #This will uses the Sheet Size for Paper size
    opts.FileName = Names
    
    sheetSet = List[ElementId]()
    for i in Sheets:       
    	sheetSet.Add(i.Id)
    
    result.append(doc.Export(Folder,sheetSet,opts))
    
    OUT = sheetSet
# ----------------------------------------
flow_check = Python(IN[0]=pdf_print)  # CPython3
# ---------- flow_check.python (1 lines) ----------
if IN[0]: OUT = True
# ----------------------------------------
file_open = Python(IN[0]=file_name, IN[1]=flow_check, IN[2]=string, IN[3]=string_2, IN[4]=string_3, IN[5]=run)  # CPython3
# ---------- file_open.python (48 lines) ----------
# Load the Python Standard and DesignScript Libraries
import sys
import clr
import os
import subprocess

#clr.AddReference('ProtoGeometry')
#from Autodesk.DesignScript.Geometry import *

# The inputs to this node will be stored as a list in the IN variables.
#dataEnteringNode = IN

# Place your code below this line


txt1 = IN[0]

#txt1 = 'C:\1.txt'
bool = IN[1]


#SPath = r'C:\Windows\System32\notepad.exe'
if IN[5]:
    try:
        if bool:
            try:
            	subprocess.Popen([IN[2], txt1])
            	OUT = 'success'
            
            		
            except:
                pass
            
            try:
                subprocess.Popen([IN[3], txt1])
                OUT = 'success'
            except:
                subprocess.Popen([IN[4], txt1])
                OUT = 'success'
    except:
        clr.AddReference('RevitAPIUI')
        from Autodesk.Revit.UI import TaskDialog
        TaskDialog.Show("Dynamo Player", "Can't find PDF viewer, please change any link in the script")
     
else: OUT = 'success'  
        
#subprocess.Popen('explorer "C:\temp"') #itWorks!
# Assign your output to the OUT variable.
# ----------------------------------------
folder_open = Python(IN[0]=watch, IN[1]=file_open)  # CPython3
# ---------- folder_open.python (13 lines) ----------
if IN[1] == 'success':
	import sys
	import clr
	import os
	import subprocess
	
	txt2 = str('explorer '+'"'+str(IN[0])+'"')	
	
	if bool:
		#subprocess.Popen(txt2)
		os.startfile(IN[0]) #this one do not open explorer again and again
			
OUT = 0
# ----------------------------------------
