# Dynamo graph Rev.Clouds_Override_script.dyn (Dynamo 3.0.3.7597)

get_all_revisions = Python()  # CPython3; unwired: IN[0]
# ---------- get_all_revisions.python (25 lines) ----------
import clr

clr.AddReference('RevitAPI')
from Autodesk.Revit.DB import *
clr.AddReference("RevitNodes")
import Revit
clr.ImportExtensions(Revit.Elements)

clr.AddReference("RevitServices")
import RevitServices
from RevitServices.Persistence import DocumentManager
from RevitServices.Transactions import TransactionManager


doc = DocumentManager.Instance.CurrentDBDocument

#getting all the views required
#lv = FilteredElementCollector(doc).OfClass(ViewPlan).WhereElementIsNotElementType().ToElements()

#xx = FilteredElementCollector(doc).OfClass(ViewSection).WhereElementIsNotElementType().ToElements()

yy = FilteredElementCollector(doc).OfClass(RevisionCloud).ToElements()


OUT = yy
# ----------------------------------------
get_date = Python(IN[0]=get_all_revisions)  # CPython3
# ---------- get_date.python (27 lines) ----------
import clr
clr.AddReference('ProtoGeometry')
from Autodesk.DesignScript.Geometry import *

clr.AddReference('RevitServices')
import RevitServices
from RevitServices.Persistence import DocumentManager
from RevitServices.Transactions import TransactionManager

clr.AddReference('RevitAPI')
import Autodesk
from Autodesk.Revit.DB import *

clr.AddReference('RevitNodes')
import Revit
clr.ImportExtensions(Revit.Elements)
clr.ImportExtensions(Revit.GeometryConversion)

tags = UnwrapElement(IN[0])
#tags2 = UnwrapElement(IN[1])

f = []
for i in tags: f.append(i.get_Parameter(BuiltInParameter.REVISION_CLOUD_REVISION_DATE).AsString())
#z = []
#for i in tags2: z.append(i.get_Parameter(BuiltInParameter.REVISION_CLOUD_REVISION_DATE).AsString())

OUT = f
# ----------------------------------------
# note: it's possible to have cloud but no tag
sorted = Python(IN[0]=get_date)  # CPython3
# ---------- sorted.python (45 lines) ----------
k = list(set(IN[0]))
y = []

for i in k:
	if len(i)<2: #check empty and make it first
		x = "999999999"
		y.append(x)	
	else:
		if (i)[:4] == "Date": #check Date 9 default names and sent them to back
			x = "00000"+i[len(i)-2:]
			mm = x.replace(" ","0")
			y.append(mm)
			
		else:
			if len(i)<=9: #check for 2020 year instead of just 20
				x = "20"+i[6:8]+i[3:5]+i[0:2]
				y.append(x)
			else:
				if len(i)<11:
					x = i[6:10]+i[3:5]+i[0:2]
					y.append(x)	



c = zip(y, k)

f = sorted(c)
#strange way to get second element from every sublist
#OUT =  [element for _, element in f]
zz = []

for i in range(0, len(k)-1):
	if f[i][0][:1]=="9": #remove all the Date 9 and noname dates
		do = "nothing"
	else:	
		if f[i][0]==f[i+1][0]: #remove double name #==f[i+1]
			do = "nothing"
		else:
			zz.append(f[i][1])

if f[len(k)-1][0][:1]=="9": do = "nothing"
else: zz.append(f[len(k)-1][1])

OUT = zz
 
# ----------------------------------------
reverse = List.Reverse(list=sorted)
get_all_revision_tags = Python()  # CPython3; unwired: IN[0]
# ---------- get_all_revision_tags.python (28 lines) ----------
import clr

clr.AddReference('RevitAPI')
from Autodesk.Revit.DB import *
clr.AddReference("RevitNodes")
import Revit
clr.ImportExtensions(Revit.Elements)

clr.AddReference("RevitServices")
import RevitServices
from RevitServices.Persistence import DocumentManager
from RevitServices.Transactions import TransactionManager


doc = DocumentManager.Instance.CurrentDBDocument

#getting all the views required
#lv = FilteredElementCollector(doc).OfClass(ViewPlan).WhereElementIsNotElementType().ToElements()

#xx = FilteredElementCollector(doc).OfClass(ViewSection).WhereElementIsNotElementType().ToElements()

#yy = FilteredElementCollector(doc).OfClass(typeof(IndependentTag)).Cast<IndependentTag>().Where<IndependentTag>(tag => tag.IsMaterialTag == true)

#yy = FilteredElementCollector(doc).OfClass(IndependentTag)

yy= FilteredElementCollector(doc).OfCategory(BuiltInCategory.OST_RevisionCloudTags).WhereElementIsNotElementType().ToElements()

OUT = yy
# ----------------------------------------
get_tagged_element = Python(IN[0]=get_all_revision_tags)  # CPython3
# ---------- get_tagged_element.python (30 lines) ----------
import clr
clr.AddReference('ProtoGeometry')
from Autodesk.DesignScript.Geometry import *

clr.AddReference('RevitServices')
import RevitServices
from RevitServices.Persistence import DocumentManager
from RevitServices.Transactions import TransactionManager

clr.AddReference('RevitAPI')
import Autodesk
from Autodesk.Revit.DB import *

clr.AddReference('RevitNodes')
import Revit
clr.ImportExtensions(Revit.Elements)
clr.ImportExtensions(Revit.GeometryConversion)

tags = UnwrapElement(IN[0])
taggedelements = []
doc = DocumentManager.Instance.CurrentDBDocument
TransactionManager.Instance.EnsureInTransaction(doc)

for i in tags:
    taggedelements.append(i.GetTaggedLocalElements())

taggedelements1 = sum(taggedelements,[]) #This is very inefficient. But fun
TransactionManager.Instance.EnsureInTransaction(doc)

OUT = taggedelements1
# ----------------------------------------
get_date_2 = Python(IN[0]=get_tagged_element)  # CPython3; same code as get_date
sorting_one_list_by_another = Python(IN[0]=reverse, IN[1]=get_all_revision_tags, IN[2]=get_date_2)  # CPython3
# ---------- sorting_one_list_by_another.python (20 lines) ----------
zipped = list(zip(IN[2],IN[1]))


dates = IN[0]

z = []
for j in range(0,len(dates)): #getting for every date
	s = []
	b = []
	
	for i in range(0,len(IN[2])): #getting for all the lists
		s.append(dates[j] in zipped[i][0])
		if s[i] == True: b.append(zipped[i][1].Id)
		else: b.append('nothing')
	z.append(b)	




OUT = z
# ----------------------------------------
color_palette = ColorPalette({R: 220, G: 20, B: 60, A: 255})
color_palette_2 = ColorPalette({R: 0, G: 0, B: 205, A: 255})
color_palette_3 = ColorPalette({R: 75, G: 0, B: 130, A: 255})
color_palette_4 = ColorPalette({R: 255, G: 20, B: 147, A: 255})
color_palette_5 = ColorPalette({R: 47, G: 79, B: 79, A: 255})
color_palette_6 = ColorPalette({R: 255, G: 140, B: 0, A: 255})
color_palette_7 = ColorPalette({R: 160, G: 82, B: 45, A: 255})
color_palette_8 = ColorPalette({R: 255, G: 99, B: 71, A: 255})
color_palette_9 = ColorPalette({R: 154, G: 205, B: 50, A: 255})
color_palette_10 = ColorPalette({R: 50, G: 205, B: 50, A: 255})
color_palette_11 = ColorPalette({R: 153, G: 50, B: 204, A: 255})
color_palette_12 = ColorPalette({R: 0, G: 0, B: 0, A: 255})
color_palette_13 = ColorPalette({R: 32, G: 178, B: 170, A: 255})
color_palette_14 = ColorPalette({R: 30, G: 144, B: 255, A: 255})
list_create = List.Create(item0=color_palette, item1=color_palette_2, item2=color_palette_3, item3=color_palette_4, item4=color_palette_5, item5=color_palette_6, item6=color_palette_7, item7=color_palette_8, item8=color_palette_9, item9=color_palette_10, item10=color_palette_11, item11=color_palette_12, item12=color_palette_13, item13=color_palette_14)
run_it = BoolSelector(true)
# note: for some reason script doesn't work if list contains of tags and clouds together so I divided them, not a big deal
view_set_element_overrides = Python(IN[0]=sorting_one_list_by_another, IN[1]=list_create, IN[2]=run_it)  # CPython3
# ---------- view_set_element_overrides.python (58 lines) ----------
import clr

clr.AddReference('RevitAPI')
from Autodesk.Revit.DB import *
clr.AddReference("RevitNodes")
import Revit
clr.ImportExtensions(Revit.Elements)

clr.AddReference("RevitServices")
import RevitServices
from RevitServices.Persistence import DocumentManager
from RevitServices.Transactions import TransactionManager


doc = DocumentManager.Instance.CurrentDBDocument


elementid = IN[0]

rgbcolor = IN[1]


def runit():
    if IN[2] == True:
        #getting all the views required
        lv = FilteredElementCollector(doc).OfClass(ViewPlan).WhereElementIsNotElementType().ToElements()
        
        xx = FilteredElementCollector(doc).OfClass(ViewSection).WhereElementIsNotElementType().ToElements()
        
        yy = FilteredElementCollector(doc).OfClass(ViewSheet).WhereElementIsNotElementType().ToElements()
        
        view = []
        for i in lv:
            if i.IsTemplate != True:
                view.append(i)
        for i in xx:
            if i.IsTemplate != True:
                view.append(i)
        for i in yy:
            if i.IsTemplate !=True:
                view.append(i)
        
        cv = []
        for i in rgbcolor: 
            ogs = OverrideGraphicSettings().SetProjectionLineColor(Color(i.Red,i.Green,i.Blue))
            cv.append(ogs)
        
        TransactionManager.Instance.EnsureInTransaction(doc)
        for i in view:
            for j in range(0,len(elementid)):
                for f in elementid[j]:
                    if f!='nothing':
                        i.SetElementOverrides(ElementId(f), cv[j])
        TransactionManager.Instance.TransactionTaskDone()
    
    else: cv = "set bool to true"
    return cv
OUT = runit()
# ----------------------------------------
code_block = CodeBlock { "from latest down to oldest"; "red is always latest or remove REVERSE node"; }
sorting_one_list_by_another_2 = Python(IN[0]=reverse, IN[1]=get_all_revisions, IN[2]=get_date)  # CPython3
# ---------- sorting_one_list_by_another_2.python (21 lines) ----------
zipped = list(zip(IN[2],IN[1]))


dates = IN[0]

z = []
for j in range(0,len(dates)): #getting for every date
	s = []
	b = []
	
	for i in range(0,len(IN[2])): #getting for all the lists
		s.append(dates[j] in zipped[i][0])
		if s[i] == True: b.append(zipped[i][1].Id)
		else: b.append('nothing')
	
	z.append(b)	




OUT = z
# ----------------------------------------
view_set_element_overrides_2 = Python(IN[0]=sorting_one_list_by_another_2, IN[1]=list_create, IN[2]=run_it)  # CPython3
# ---------- view_set_element_overrides_2.python (59 lines) ----------
import clr

clr.AddReference('RevitAPI')
from Autodesk.Revit.DB import *
clr.AddReference("RevitNodes")
import Revit
clr.ImportExtensions(Revit.Elements)

clr.AddReference("RevitServices")
import RevitServices
from RevitServices.Persistence import DocumentManager
from RevitServices.Transactions import TransactionManager


doc = DocumentManager.Instance.CurrentDBDocument


elementid = IN[0]

rgbcolor = IN[1]


def runit():
    if IN[2] == True:
        #getting all the views required
        lv = FilteredElementCollector(doc).OfClass(ViewPlan).WhereElementIsNotElementType().ToElements()
        
        xx = FilteredElementCollector(doc).OfClass(ViewSection).WhereElementIsNotElementType().ToElements()
        
        yy = FilteredElementCollector(doc).OfClass(ViewSheet).WhereElementIsNotElementType().ToElements()
        
        view = []
        for i in lv:
           if i.IsTemplate != True:
               view.append(i)
        for i in xx:
           if i.IsTemplate != True:
               view.append(i)
        for i in yy:
            if i.IsTemplate !=True:
               view.append(i)
        
        cv = []
        for i in rgbcolor: 
            ogs = OverrideGraphicSettings().SetProjectionLineColor(Color(i.Red,i.Green,i.Blue))
            cv.append(ogs)
        
        TransactionManager.Instance.EnsureInTransaction(doc)
        for i in view:
            for j in range(0,len(elementid)):
                for f in elementid[j]:
                    if f!='nothing':
                        i.SetElementOverrides(ElementId(f), cv[j])
                    
        TransactionManager.Instance.TransactionTaskDone()
    
    else: cv = "set bool to true"
    return cv
OUT = runit()
# ----------------------------------------
# note: situation when we need multiple red colors
remove_all_normal_dates = Python(IN[0]=get_date)  # CPython3
# ---------- remove_all_normal_dates.python (45 lines) ----------
k = list(set(IN[0]))
y = []

for i in k:
	if len(i)<2: #check empty and make it first
		x = "999999999"
		y.append(x)	
	else:
		if (i)[:4] == "Date": #check Date 9 default names and sent them on top
			x = "999999"+i[len(i)-2:]
			mm = x.replace(" ","0")
			y.append(mm)
			
		else:
			if len(i)<=9: #check for 2020 year instead of just 20
				x = "20"+i[6:8]+i[3:5]+i[0:2]
				y.append(x)
			else:
				if len(i)<11:
					x = i[6:10]+i[3:5]+i[0:2]
					y.append(x)	

c = zip(y, k)

f = sorted(c)
#strange way to get second element from every sublist
#sorted_elements =  [element for _, element in f]
ss = []
for i in range(0, len(f)-1):
	if f[i][0][:1] == "9":  #check for first 9
		ss.append(f[i][1])
	elif f[i][0] == f[i+1][0]: #check for double
		ss.append(f[i][1])
		
if f[len(f)-1][0][:1]=="9": ss.append(f[len(f)-1][1])


#we can filter all Data9 
xm = []
for i in ss:
	if i[:4]!="Date":xm.append(i)



OUT = xm
# ----------------------------------------
compare_two_lists = Python(IN[0]=get_date_2, IN[1]=remove_all_normal_dates)  # CPython3
# ---------- compare_two_lists.python (13 lines) ----------
dates = IN[0]
dates_stay = IN[1]

outt = []
tt = []
m = []
for i in dates:
	for j in dates_stay:
		if i == j: m =True
	if m != True: outt.append(False)
	else: outt.append(True)

OUT = outt
# ----------------------------------------
filterByBoolMask = List.FilterByBoolMask(list=get_all_revision_tags, mask=compare_two_lists)
get_tagged_element_2 = Python(IN[0]=filterByBoolMask.in)  # CPython3
# ---------- get_tagged_element_2.python (31 lines) ----------
import clr
clr.AddReference('ProtoGeometry')
from Autodesk.DesignScript.Geometry import *

clr.AddReference('RevitServices')
import RevitServices
from RevitServices.Persistence import DocumentManager
from RevitServices.Transactions import TransactionManager

clr.AddReference('RevitAPI')
import Autodesk
from Autodesk.Revit.DB import *

clr.AddReference('RevitNodes')
import Revit
clr.ImportExtensions(Revit.Elements)
clr.ImportExtensions(Revit.GeometryConversion)

tags = UnwrapElement(IN[0])
taggedelements = []
doc = DocumentManager.Instance.CurrentDBDocument
TransactionManager.Instance.EnsureInTransaction(doc)

for i in tags:
	tagID = doc.GetElement(i.Id)
	taggedElem = doc.GetElement(tagID.TaggedLocalElementId)
	taggedelements.Add(taggedElem)

TransactionManager.Instance.EnsureInTransaction(doc)

OUT = taggedelements
# ----------------------------------------
get_date_3 = Python(IN[0]=get_tagged_element_2)  # CPython3; same code as get_date
sorting_one_list_by_another_3 = Python(IN[0]=remove_all_normal_dates, IN[1]=filterByBoolMask.in, IN[2]=get_date_3)  # CPython3
# ---------- sorting_one_list_by_another_3.python (20 lines) ----------
zipped = zip(IN[2],IN[1])


dates = IN[0]

z = []
for j in range(0,len(dates)): #getting for every date
	s = []
	b = []
	
	for i in range(0,len(IN[2])): #getting for all the lists
		s.append(dates[j] in zipped[i][0])
		if s[i] == True: b.append(zipped[i][1].Id)
		else: b.append('nothing')
	z.append(b)	




OUT = z
# ----------------------------------------
color_palette_15 = ColorPalette({R: 220, G: 20, B: 60, A: 255})
list_create_2 = List.Create(item0=color_palette_15, item1=color_palette_15, item2=color_palette_15, item3=color_palette_15, item4=color_palette_15, item5=color_palette_15, item6=color_palette_15, item7=color_palette_15, item8=color_palette_15, item9=color_palette_15, item10=color_palette_15, item11=color_palette_15, item12=color_palette_15, item13=color_palette_15)
run_it_2 = BoolSelector(true)
view_set_element_overrides_3 = Python(IN[0]=sorting_one_list_by_another_3, IN[1]=list_create_2, IN[2]=run_it_2)  # CPython3
# ---------- view_set_element_overrides_3.python (57 lines) ----------
import clr

clr.AddReference('RevitAPI')
from Autodesk.Revit.DB import *
clr.AddReference("RevitNodes")
import Revit
clr.ImportExtensions(Revit.Elements)

clr.AddReference("RevitServices")
import RevitServices
from RevitServices.Persistence import DocumentManager
from RevitServices.Transactions import TransactionManager


doc = DocumentManager.Instance.CurrentDBDocument


elementid = IN[0]

rgbcolor = IN[1]


def runit():
	if IN[2] == True:
		#getting all the views required
		lv = FilteredElementCollector(doc).OfClass(ViewPlan).WhereElementIsNotElementType().ToElements()
		
		xx = FilteredElementCollector(doc).OfClass(ViewSection).WhereElementIsNotElementType().ToElements()
		
		yy = FilteredElementCollector(doc).OfClass(ViewSheet).WhereElementIsNotElementType().ToElements()
		
		view = []
		for i in lv:
			view.append(i)
		
		for i in xx:
			view.append(i)
			
		for i in yy:
			view.append(i)
		
		cv = []
		for i in rgbcolor: 
			ogs = OverrideGraphicSettings().SetProjectionLineColor(Color(i.Red,i.Green,i.Blue))
			cv.append(ogs)
		
		TransactionManager.Instance.EnsureInTransaction(doc)
		for i in view:
			for j in range(0,len(elementid)):
				for f in elementid[j]:
					if f!='nothing':
						i.SetElementOverrides(ElementId(f), cv[j])
		TransactionManager.Instance.TransactionTaskDone()
	
	else: cv = "set bool to true"
	return cv
OUT = runit()
# ----------------------------------------
compare_two_lists_2 = Python(IN[0]=get_date, IN[1]=remove_all_normal_dates)  # CPython3; same code as compare_two_lists
filterByBoolMask_2 = List.FilterByBoolMask(list=get_all_revisions, mask=compare_two_lists_2)
get_date_4 = Python(IN[0]=filterByBoolMask_2.in)  # CPython3; same code as get_date
sorting_one_list_by_another_4 = Python(IN[0]=remove_all_normal_dates, IN[1]=filterByBoolMask_2.in, IN[2]=get_date_4)  # CPython3
# ---------- sorting_one_list_by_another_4.python (21 lines) ----------
zipped = zip(IN[2],IN[1])


dates = IN[0]

z = []
for j in range(0,len(dates)): #getting for every date
	s = []
	b = []
	
	for i in range(0,len(IN[2])): #getting for all the lists
		s.append(dates[j] in zipped[i][0])
		if s[i] == True: b.append(zipped[i][1].Id)
		else: b.append('nothing')
	
	z.append(b)	




OUT = z
# ----------------------------------------
view_set_element_overrides_4 = Python(IN[0]=sorting_one_list_by_another_4, IN[1]=list_create_2, IN[2]=run_it_2)  # CPython3
# ---------- view_set_element_overrides_4.python (58 lines) ----------
import clr

clr.AddReference('RevitAPI')
from Autodesk.Revit.DB import *
clr.AddReference("RevitNodes")
import Revit
clr.ImportExtensions(Revit.Elements)

clr.AddReference("RevitServices")
import RevitServices
from RevitServices.Persistence import DocumentManager
from RevitServices.Transactions import TransactionManager


doc = DocumentManager.Instance.CurrentDBDocument


elementid = IN[0]

rgbcolor = IN[1]


def runit():
	if IN[2] == True:
		#getting all the views required
		lv = FilteredElementCollector(doc).OfClass(ViewPlan).WhereElementIsNotElementType().ToElements()
		
		xx = FilteredElementCollector(doc).OfClass(ViewSection).WhereElementIsNotElementType().ToElements()
		
		yy = FilteredElementCollector(doc).OfClass(ViewSheet).WhereElementIsNotElementType().ToElements()
		
		view = []
		for i in lv:
			view.append(i)
		
		for i in xx:
			view.append(i)
			
		for i in yy:
			view.append(i)
		
		cv = []
		for i in rgbcolor: 
			ogs = OverrideGraphicSettings().SetProjectionLineColor(Color(i.Red,i.Green,i.Blue))
			cv.append(ogs)
		
		TransactionManager.Instance.EnsureInTransaction(doc)
		for i in view:
			for j in range(0,len(elementid)):
				for f in elementid[j]:
					if f!='nothing':
						i.SetElementOverrides(ElementId(f), cv[j])
					
		TransactionManager.Instance.TransactionTaskDone()
	
	else: cv = "set bool to true"
	return cv
OUT = runit()
# ----------------------------------------
