# Dynamo graph Sheets_END_to_rename_script.dyn (Dynamo 3.0.3.7597)

code_block = CodeBlock { "Sheets"; }
byName = Category.ByName(name=code_block)
all_elements_of_category = ElementsOfCategory(Category=byName)
user_ui_python_2_req = Python()  # IronPython2; unwired: IN[0]
# ---------- user_ui_python_2_req.python (75 lines) ----------
import clr
clr.AddReference('PresentationCore')
clr.AddReference('PresentationFramework')

from System.Windows import Application, Window, Thickness
from System.Windows.Controls import Button, TextBox, StackPanel, TextBlock, DockPanel

class MyWindow(Window):
    def __init__(self):
        self.Title = "Input Sheet Parameters"
        self.Width = 300
        self.Height = 200

        # Create a StackPanel to hold everything
        self.stack_panel = StackPanel()

        # Function to create labeled text fields in a single line
        def create_labeled_textbox(label_text, placeholder_text):
            container = DockPanel()
            container.Margin = Thickness(5)

            text_label = TextBlock()
            text_label.Text = label_text
            text_label.Width = 150  # Fixed width for alignment
            text_label.Margin = Thickness(5)

            text_box = TextBox()
            text_box.Width = 100
            text_box.Margin = Thickness(5)
            text_box.Text = placeholder_text  # Placeholder text

            container.Children.Add(text_label)
            container.Children.Add(text_box)

            return container, text_box

        # Create labeled text fields with placeholders
        self.container1, self.text_box1 = create_labeled_textbox("Rename END from", "A104 or A1.10")
        self.container2, self.text_box2 = create_labeled_textbox("Up to N sheets", "10")
        self.container3, self.text_box3 = create_labeled_textbox("+x or -x sheets", "+1")

        # Add input fields to the StackPanel
        self.stack_panel.Children.Add(self.container1)
        self.stack_panel.Children.Add(self.container2)
        self.stack_panel.Children.Add(self.container3)

        # Create Send Button
        self.send_button = Button()
        self.send_button.Content = "Send"
        self.send_button.Margin = Thickness(10)
        self.send_button.Click += self.on_send_button_click

        # Add button to StackPanel
        self.stack_panel.Children.Add(self.send_button)

        # Set window content
        self.Content = self.stack_panel

        # Store user input
        self.user_inputs = [None, None, None]

    def on_send_button_click(self, sender, e):
        # Capture user input
        self.user_inputs[0] = self.text_box1.Text
        self.user_inputs[1] = self.text_box2.Text
        self.user_inputs[2] = self.text_box3.Text
        
        self.Close()  # Close window after capturing input

# Create and show the window
window = MyWindow()
window.ShowDialog()  # Ensures script waits for user input

# Return the collected input values to Dynamo
OUT = window.user_inputs
# ----------------------------------------
code_block_2 = CodeBlock(a=user_ui_python_2_req) { a[0]; }
check_for_special_symbol = Python(IN[0]=code_block_2)  # CPython3
# ---------- check_for_special_symbol.python (8 lines) ----------
x = IN[0]
z = ""
if "." in x: z = "."
else: 
	z = ""


OUT = z
# ----------------------------------------

# group: generating list required to rename
beginning = Python(IN[0]=code_block_2)  # CPython3
# ---------- beginning.python (13 lines) ----------
if isinstance(IN[0], list): x = IN[0]
else: x = [IN[0]]
z = []

if "." in x[0]: 
	for i in x:
		z.append(i.split(".")[0])
else: 
	for i in x:
		z.append(filter(str.isalpha, i[:-1])) #x[:-1] to avoid situations where a letter at the end


OUT = z
# ----------------------------------------
flatten_safety = Python(IN[0]=beginning)  # CPython3
# ---------- flatten_safety.python (9 lines) ----------
try:
    if isinstance(IN[0], list):t = IN[0][0]
    else: t = IN[0]
    if isinstance(t, list):t = t[0]
    else: t = t  
    if isinstance(t, list):t = t[0]
    else: t = t    
except: t =[]
OUT = t
# ----------------------------------------
code_block_3 = CodeBlock { "0"; }
end = Python(IN[0]=code_block_2)  # CPython3
# ---------- end.python (14 lines) ----------
if isinstance(IN[0], list):
	x = IN[0]
else: x = [IN[0]]
z = []

if "." in x[0]: 
	for i in x:
		z.append(int(i.split(".")[1]))
else: 
	for i in x:
	   z.append("".join([c for i in x for c in i if c.isdigit()]))


OUT = z
# ----------------------------------------
flatten_safety_2 = Python(IN[0]=end)  # CPython3
# ---------- flatten_safety_2.python (9 lines) ----------
try:
    if isinstance(IN[0], list):t = IN[0][0]
    else: t = IN[0]
    if isinstance(t, list):t = t[0]
    else: t = t  
    if isinstance(t, list):t = t[0]
    else: t = t    
except: t =[]
OUT = int(t)
# ----------------------------------------
code_block_4 = CodeBlock { 1; }
code_block_5 = CodeBlock { 10; }
code_block_6 = CodeBlock { 9; }

code_block_7 = CodeBlock(a=user_ui_python_2_req) { a[1]; }
toNumber = String.ToNumber(string=code_block_7)
add = flatten_safety_2 + toNumber

# group (continued): generating list required to rename
code_block_8 = CodeBlock(first=flatten_safety_2, second=add, spc=code_block_4) { first..second..~spc; }
lt = code_block_8 < code_block_5
filterByBoolMask = List.FilterByBoolMask(list=code_block_8, mask=lt)
watch = Watch(filterByBoolMask.in)
code_block_9 = CodeBlock(one=flatten_safety, two=check_for_special_symbol, three=code_block_3, four=watch) { one+two+three+four; }
gt = code_block_8 > code_block_6
filterByBoolMask_2 = List.FilterByBoolMask(list=code_block_8, mask=gt)
code_block_10 = CodeBlock(one=flatten_safety, two=check_for_special_symbol, three=filterByBoolMask_2.in) { one+two+three; }
list_create = List.Create(item0=code_block_9, item1=code_block_10)
flatten = List.Flatten(list=list_create)

# group: Filter existing sheets to find required
code_block_11 = CodeBlock { "Sheet Number"; }
parameterByName = Parameter.ParameterByName(element=all_elements_of_category, name=code_block_11)
string_from_object = FromObject(obj=parameterByName)
code_block_12 = CodeBlock { " : "; }
split = String.Split(string=string_from_object, separator0=code_block_12)
code_block_13 = CodeBlock { 2; }
code_block_14 = CodeBlock { -1; }
dropEveryNthItem = List.DropEveryNthItem(list=split, n=code_block_13, offset=code_block_14, lacing=Longest)
flatten_2 = List.Flatten(list=dropEveryNthItem)
sorted = Python(IN[0]=flatten_2)  # CPython3
# ---------- sorted.python (1 lines) ----------
OUT = sorted(IN[0])
# ----------------------------------------
contains = List.Contains(list=sorted, item=flatten, lacing=CrossProduct)
boolean = BoolSelector(true)
contains_2 = List.Contains(list=contains, item=boolean, lacing=Longest)

sorted_2 = Python(IN[0]=all_elements_of_category, IN[1]=flatten_2)  # CPython3
# ---------- sorted_2.python (12 lines) ----------
inp = IN[0]
sorting = IN[1]


zipped = zip(sorting,inp)

sorted_zipped_lists = sorted(zipped)

#crazy way to get the second element fom any sublist
sorted_list1 = [element for _, element in sorted_zipped_lists]

OUT = sorted_list1 
# ----------------------------------------

# group (continued): Filter existing sheets to find required
watch_2 = Watch(sorted_2)
filterByBoolMask_3 = List.FilterByBoolMask(list=watch_2, mask=contains_2)
watch_3 = Watch(filterByBoolMask_3.in)

watch_4 = Watch(watch_3)

# group: getting sheets numbers
code_block_15 = CodeBlock { "Sheet Number"; }
parameterByName_2 = Parameter.ParameterByName(element=watch_3, name=code_block_15)
string_from_object_2 = FromObject(obj=parameterByName_2)
code_block_16 = CodeBlock { " : "; }
split_2 = String.Split(string=string_from_object_2, separator0=code_block_16)
code_block_17 = CodeBlock { 2; }
code_block_18 = CodeBlock { -1; }
dropEveryNthItem_2 = List.DropEveryNthItem(list=split_2, n=code_block_17, offset=code_block_18, lacing=Longest)
flatten_3 = List.Flatten(list=dropEveryNthItem_2)

rand = Math.Rand()
code_block_19 = CodeBlock { 1000; }
mul = rand * code_block_19

# group: +x random in the same order
beginning_2 = Python(IN[0]=flatten_3)  # CPython3; same code as beginning
flatten_4 = List.Flatten(list=beginning_2)
end_2 = Python(IN[0]=flatten_3)  # CPython3
# ---------- end_2.python (10 lines) ----------
if isinstance(IN[0], list):
    x = IN[0]
else: x = [IN[0]]
z = []

for i in x:
      z.append("".join(c for j in i for c in j if c.isdigit()))


OUT = z
# ----------------------------------------
ceiling = Math.Ceiling(number=mul)
code_block_20 = CodeBlock(one=flatten_4, two=end_2, three=ceiling) { one+two+three; }

# group: fake rename to avoid error
setParameterByName = Element.SetParameterByName(element=watch_4, parameterName=code_block_15, value=code_block_20)

code_block_21 = CodeBlock(a=user_ui_python_2_req) { a[2]; }

# group: +/- number in the same order
beginning_3 = Python(IN[0]=flatten_3)  # CPython3; same code as beginning
check_for_special_symbol_2 = Python(IN[0]=flatten_3)  # CPython3
# ---------- check_for_special_symbol_2.python (8 lines) ----------
x = IN[0][0]
z = ""
if "." in x: z = "."
else: 
	z = ""


OUT = z
# ----------------------------------------
code_block_22 = CodeBlock { "0"; }
end_3 = Python(IN[0]=flatten_3)  # CPython3
# ---------- end_3.python (14 lines) ----------
if isinstance(IN[0], list):
    x = IN[0]
else: x = [IN[0]]
z = []

if "." in x[0]: 
    for i in x:
        z.append(int(i.split(".")[1]))
else: 
    for i in x:
       z.append(int("".join(c for j in i for c in j if c.isdigit())))


OUT = z
# ----------------------------------------
toNumber_2 = String.ToNumber(string=code_block_21)
add_2 = end_3 + toNumber_2
code_block_23 = CodeBlock { 10; }
lt_2 = add_2 < code_block_23
filterByBoolMask_4 = List.FilterByBoolMask(list=add_2, mask=lt_2)
watch_5 = Watch(filterByBoolMask_4.in)
code_block_24 = CodeBlock(one=beginning_3, two=check_for_special_symbol_2, three=code_block_22, four=watch_5) { one+two+three+four; }
code_block_25 = CodeBlock { 9; }
gt_2 = add_2 > code_block_25
filterByBoolMask_5 = List.FilterByBoolMask(list=add_2, mask=gt_2)
code_block_26 = CodeBlock(one=beginning_3, two=check_for_special_symbol_2, three=filterByBoolMask_5.in) { one+two+three; }
list_create_2 = List.Create(item0=code_block_24, item1=code_block_26)
flatten_5 = List.Flatten(list=list_create_2)

setParameterByName_2 = Element.SetParameterByName(element=setParameterByName, parameterName=code_block_15, value=flatten_5)
