# Dynamo graph Sheets_PREFIX_to_rename_script.dyn (Dynamo 3.0.3.7597)

user_ui_python_2_req = Python()  # IronPython2; unwired: IN[0]
# ---------- user_ui_python_2_req.python (75 lines) ----------
import clr
clr.AddReference('PresentationCore')
clr.AddReference('PresentationFramework')

from System.Windows import Application, Window, Thickness
from System.Windows.Controls import Button, TextBox, StackPanel, TextBlock, DockPanel

class MyWindow(Window):
    def __init__(self):
        self.Title = "Input Sheet Parameters"
        self.Width = 300
        self.Height = 200

        # Create a StackPanel to hold everything
        self.stack_panel = StackPanel()

        # Function to create labeled text fields in a single line
        def create_labeled_textbox(label_text, placeholder_text):
            container = DockPanel()
            container.Margin = Thickness(5)

            text_label = TextBlock()
            text_label.Text = label_text
            text_label.Width = 150  # Fixed width for alignment
            text_label.Margin = Thickness(5)

            text_box = TextBox()
            text_box.Width = 100
            text_box.Margin = Thickness(5)
            text_box.Text = placeholder_text  # Placeholder text

            container.Children.Add(text_label)
            container.Children.Add(text_box)

            return container, text_box

        # Create labeled text fields with placeholders
        self.container1, self.text_box1 = create_labeled_textbox("Prefix to rename", "A6 or A")
        self.container2, self.text_box2 = create_labeled_textbox("Prefix you want", "S")
        self.container3, self.text_box3 = create_labeled_textbox("Optional: apply to N sheets", "1000")

        # Add input fields to the StackPanel
        self.stack_panel.Children.Add(self.container1)
        self.stack_panel.Children.Add(self.container2)
        self.stack_panel.Children.Add(self.container3)

        # Create Send Button
        self.send_button = Button()
        self.send_button.Content = "Send"
        self.send_button.Margin = Thickness(10)
        self.send_button.Click += self.on_send_button_click

        # Add button to StackPanel
        self.stack_panel.Children.Add(self.send_button)

        # Set window content
        self.Content = self.stack_panel

        # Store user input
        self.user_inputs = [None, None, None]

    def on_send_button_click(self, sender, e):
        # Capture user input
        self.user_inputs[0] = self.text_box1.Text
        self.user_inputs[1] = self.text_box2.Text
        self.user_inputs[2] = self.text_box3.Text
        
        self.Close()  # Close window after capturing input

# Create and show the window
window = MyWindow()
window.ShowDialog()  # Ensures script waits for user input

# Return the collected input values to Dynamo
OUT = window.user_inputs
# ----------------------------------------
initial = CodeBlock(a=user_ui_python_2_req) { a[0]; }

# group: Filtering project sheets
code_block = CodeBlock { "Sheets"; }
byName = Category.ByName(name=code_block)
all_elements_of_category = ElementsOfCategory(Category=byName)
code_block_2 = CodeBlock { "Sheet Number"; }
parameterByName = Parameter.ParameterByName(element=all_elements_of_category, name=code_block_2)
smart_filtering = Python(IN[0]=parameterByName)  # CPython3
# ---------- smart_filtering.python (11 lines) ----------
x = IN[0]
tostr = []
splitted = []

for i in x:
    tostr.append(str(i))
    
for i in tostr:    
    splitted.append(i.split(" : ")[1])
      
OUT = splitted
# ----------------------------------------
bool_mask = Python(IN[0]=initial, IN[1]=smart_filtering, IN[2]=parameterByName, IN[3]=all_elements_of_category)  # CPython3
# ---------- bool_mask.python (13 lines) ----------
req1 = IN[0]
x = IN[1]
act_list = IN[2]
alist2 = IN[3]
c = []
d =[]

for i in range(len(x)):
    if req1 in x[i]:
        c.append(act_list[i])
        d.append(alist2[i])
        
OUT = [c,d]
# ----------------------------------------
revit_element = CodeBlock(a=bool_mask) { a[1]; }
name = CodeBlock(a=bool_mask) { a[0]; }
string_from_object = FromObject(object=name)

watch = Watch(revit_element)
code_block_3 = CodeBlock { " : "; }
split = String.Split(string=string_from_object, separator0=code_block_3)
code_block_4 = CodeBlock { 2; }
code_block_5 = CodeBlock { -1; }
dropEveryNthItem = List.DropEveryNthItem(list=split, n=code_block_4, offset=code_block_5, lacing=Longest)

# group: project list
flatten = List.Flatten(list=dropEveryNthItem)

code_block_6 = CodeBlock(a=initial) { a; }

# group: prefix . -
generate_suffix = Python(IN[0]=string_from_object)  # CPython3
# ---------- generate_suffix.python (5 lines) ----------
x = IN[0]
xlast = x[len(x)-1]
if "." in xlast: OUT = "."
elif "-" in xlast: OUT = "-"
else: OUT = ""
# ----------------------------------------

code_block_7 = CodeBlock(a=generate_suffix) { a+"0"; }
number = DoubleInput(1)
number_2 = DoubleInput(9)
code_block_8 = CodeBlock { 1; }
code_block_9 = CodeBlock(first=number, second=number_2, spc=code_block_8) { first..second..~spc; }
code_block_10 = CodeBlock(one=code_block_6, two=code_block_7, three=code_block_9) { one+two+three; }
number_3 = DoubleInput(10)

# group: default max
number_4 = DoubleInput(200)

code_block_11 = CodeBlock { 1; }
code_block_12 = CodeBlock(first=number_3, second=number_4, spc=code_block_11) { first..second..~spc; }
code_block_13 = CodeBlock(one=code_block_6, two=generate_suffix, three=code_block_12) { one+two+three; }
list_create = List.Create(item0=code_block_10, item1=code_block_13)
flatten_2 = List.Flatten(list=list_create)
code_block_14 = CodeBlock(a=user_ui_python_2_req) { a[2]; }
toNumber = String.ToNumber(string=code_block_14)
check = Python(IN[0]=toNumber, IN[1]=flatten_2)  # CPython3
# ---------- check.python (4 lines) ----------
if(IN[0]):
    OUT = IN[0]
else:
    OUT = len(IN[1])
# ----------------------------------------

# group: generated list
takeItems = List.TakeItems(list=flatten_2, amount=check)

contains = List.Contains(list=flatten, item=takeItems, lacing=CrossProduct)
boolean = BoolSelector(true)
contains_2 = List.Contains(list=contains, item=boolean, lacing=Longest)
filterByBoolMask = List.FilterByBoolMask(list=watch, mask=contains_2)
code_block_15 = CodeBlock { "Sheet Number"; }
parameterByName_2 = Parameter.ParameterByName(element=filterByBoolMask.in, name=code_block_15)
string_from_object_2 = FromObject(obj=parameterByName_2)
code_block_16 = CodeBlock { " : "; }
split_2 = String.Split(string=string_from_object_2, separator0=code_block_16)
code_block_17 = CodeBlock { 2; }
code_block_18 = CodeBlock { -1; }
dropEveryNthItem_2 = List.DropEveryNthItem(list=split_2, n=code_block_17, offset=code_block_18, lacing=Longest)
flatten_3 = List.Flatten(list=dropEveryNthItem_2)
watch_2 = Watch(code_block_6)
rename_to = CodeBlock(a=user_ui_python_2_req) { a[1]; }
replace = String.Replace(string=flatten_3, searchFor=watch_2, replaceWith=rename_to)
setParameterByName = Element.SetParameterByName(element=filterByBoolMask.in, parameterName=code_block_15, value=replace)
