# Dynamo graph SiteVision CSV to control points_script.dyn (Dynamo 3.0.3.7597)

# group: family name
name = StringInput("controlp")

stringInput = StringInput("\")
control_point_family_filepath = Python(IN[0]=name, IN[1]=stringInput)  # CPython3
# ---------- control_point_family_filepath.python (10 lines) ----------
import clr
clr.AddReference('DynamoServices')
from Dynamo.Events import *
f = ExecutionEvents.ActiveSession.CurrentWorkspacePath

a = str(f).split('pushbutton')


path = a[0] + 'pushbutton' + IN[1] + IN[0] + '.rfa'
OUT = [path, IN[0]]
# ----------------------------------------
this_script_filepath = Python(IN[0]=control_point_family_filepath)  # CPython3
# ---------- this_script_filepath.python (21 lines) ----------
import clr
clr.AddReference('RevitAPI')
clr.AddReference('RevitServices')

from Autodesk.Revit.DB import Document
from RevitServices.Persistence import DocumentManager
from RevitServices.Transactions import TransactionManager


doc = DocumentManager.Instance.CurrentDBDocument

path = IN[0][0]

TransactionManager.Instance.EnsureInTransaction(doc)

family = doc.LoadFamily(path)

TransactionManager.Instance.TransactionTaskDone()

#transfer name further
OUT = IN[0][1]
# ----------------------------------------
name_2 = StringInput("controlp-blue")
wait_for = Python(IN[0]=this_script_filepath, IN[1]=name_2)  # CPython3
# ---------- wait_for.python (2 lines) ----------
if IN[0]:
    OUT = IN[1]
# ----------------------------------------
byName = FamilyType.ByName(name=wait_for)
ui_python_2_req = Python()  # IronPython2; unwired: IN[0]
# ---------- ui_python_2_req.python (61 lines) ----------
import clr
clr.AddReference('PresentationCore')
clr.AddReference('PresentationFramework')
clr.AddReference("System.Windows.Forms")

from System.Windows import Application, Window, Thickness
from System.Windows.Controls import Button, StackPanel
from System.Windows.Forms import OpenFileDialog, DialogResult

# Global variable to store the file path
file_path = ""

class MyWindow(Window):
    def __init__(self):
        self.Title = "Import CSV"
        self.Width = 300
        self.Height = 150

        # StackPanel to hold buttons
        self.stack_panel = StackPanel()

        # Create Import CSV Button
        self.import_button = Button()
        self.import_button.Content = "Choose a CSV"
        self.import_button.Margin = Thickness(10)
        self.import_button.Click += self.on_import_button_click  # Attach event

        # Create Send Button
        self.send_button = Button()
        self.send_button.Content = "Import CSV"
        self.send_button.Margin = Thickness(10)
        self.send_button.Click += self.on_send_button_click  # Attach event

        # Add buttons to StackPanel
        self.stack_panel.Children.Add(self.import_button)
        self.stack_panel.Children.Add(self.send_button)

        # Set window content
        self.Content = self.stack_panel

    def on_import_button_click(self, sender, e):
        global file_path
        # Open File Dialog
        dialog = OpenFileDialog()
        dialog.Filter = "CSV Files (*.csv)|*.csv"
        dialog.Title = "Select a CSV File"

        # If user selects a file and clicks OK, store the path
        if dialog.ShowDialog() == DialogResult.OK:
            file_path = dialog.FileName 

    def on_send_button_click(self, sender, e):
        self.DialogResult = True  # Ensures correct exit behavior
        self.Close()  # Close the window when "Send" is clicked

# Create and show the window
window = MyWindow()
window.ShowDialog()  # Wait for user input

# Return file path (string) to Dynamo
OUT = file_path
# ----------------------------------------
importCSV = Data.ImportCSV(filePath=ui_python_2_req)
delete_todo_s = Python(IN[0]=importCSV)  # CPython3
# ---------- delete_todo_s.python (11 lines) ----------
x = IN[0]
m = []

for i in range(len(x)):
	m.append([])
	for j in range(len(x[0])):
		if "SiteVision_" not in x[2][j]:
			m[i].append(x[i][j])


OUT = m
# ----------------------------------------
delete_deleted = Python(IN[0]=delete_todo_s)  # CPython3
# ---------- delete_deleted.python (11 lines) ----------
x = IN[0]
m = []

for i in range(len(x)):
	m.append([])
	for j in range(len(x[0])):
		if x[33][j]!="Deleted":
			m[i].append(x[i][j])


OUT = m
# ----------------------------------------

# group: coordinate transformation
flip_x_y = BoolSelector(true)
local_site_base_point_false = BoolSelector(false)  # "Local site base point (False=Global)"
z_from_0 = BoolSelector(false)
x_y_h_list_for_csv = Python(IN[0]=delete_deleted, IN[1]=flip_x_y, IN[2]=local_site_base_point_false, IN[3]=z_from_0)  # CPython3
# ---------- x_y_h_list_for_csv.python (66 lines) ----------
pts = IN[0]
flip = IN[1]
outp = []
local = IN[2]
localh = IN[3]
units = IN[0][30][1:]

xx = pts[11]
yy = pts[10]
zz = pts[12]
xmin=0
ymin=0
zmin=0
x = []
y = []
z = []

if localh:
	zzz = []
	for i in range(len(pts[0])-1):
		zzz.append(zz[i+1])
		zmin = min(zzz)
		
	for i in range(len(pts[0])-1):
		z.append(zz[i+1]-zmin)

else:
	z = zz[1:]



if local:
	xxx = []
	yyy = []
	
	for i in range(len(pts[0])-1):
		xxx.append(xx[i+1])
		yyy.append(yy[i+1])
		xmin = min(xxx)
		ymin = min(yyy)
		
	for i in range(len(pts[0])-1):
		x.append(xx[i+1]-xmin)
		y.append(yy[i+1]-ymin)	

else:
	x = xx[1:]
	y = yy[1:]



for i in range(len(pts[0])-1):	

	if units[i] == "Meters":
		um = 1
	else:
		um = 0.3048
		
	if flip:
		outp.append(str(x[i]*um) + "," + str(y[i]*um) + "," + str(z[i]*um))
	else:
		outp.append(str(y[i]*um) + "," + str(x[i]*um) + "," + str(z[i]*um))
		
	um = 0

OUT = outp,xmin*um,ymin*um,zmin*um
# ----------------------------------------

get_survey_point = Python()  # CPython3; unwired: IN[0]
# ---------- get_survey_point.python (32 lines) ----------
import clr

# Add Revit API references
clr.AddReference('RevitServices')
from RevitServices.Persistence import DocumentManager

clr.AddReference('RevitAPI')
from Autodesk.Revit.DB import *

# Get the current Revit document
doc = DocumentManager.Instance.CurrentDBDocument

try:
    # Get the project location (shared coordinates)
    project_location = doc.ActiveProjectLocation

    # Get the project position (shared coordinates relative to the survey point)
    project_position = project_location.GetProjectPosition(XYZ.Zero)

    # Extract the real-world coordinates
    east_west = project_position.EastWest  # X coordinate
    north_south = project_position.NorthSouth  # Y coordinate
    elevation = project_position.Elevation  # Z coordinate

    # Create an array of doubles [x, y, z]
    survey_point_coords = [east_west, north_south, elevation]

    # Output the coordinates as an array of doubles
    OUT = survey_point_coords

except Exception as e:
    OUT = f"An error occurred: {str(e)}"
# ----------------------------------------
code_block = CodeBlock(a=get_survey_point) { a[0]; }
code_block_2 = CodeBlock(a=get_survey_point) { a[1]; }
code_block_3 = CodeBlock(a=get_survey_point) { a[2]; }

# group: Base point
easting = CodeBlock(a=code_block) { a*304.8/1000; }
northing = CodeBlock(a=code_block_2) { a*304.8/1000; }
code_block_4 = CodeBlock(a=code_block_3) { a*304.8/1000; }

relative_to_base_point = BoolSelector(true)
to_points = Python(IN[0]=x_y_h_list_for_csv, IN[1]=easting, IN[2]=northing, IN[3]=code_block_4, IN[4]=relative_to_base_point)  # CPython3
# ---------- to_points.python (19 lines) ----------
import clr
clr.AddReference("ProtoGeometry")
from Autodesk.DesignScript.Geometry import *

pt = []
p = IN[0][0]
sw = IN[4]

for i in range(len(p)):
	x = float(p[i].split(",")[0])
	y = float(p[i].split(",")[1])
	z = float(p[i].split(",")[2])

	if sw:
		pt.append(Point.ByCoordinates(x-IN[1],y-IN[2],z-IN[3]))
	else:
		pt.append(Point.ByCoordinates(x,y,z))
	
OUT = pt
# ----------------------------------------

# group: get rotation
surveyPoint = Coordinates.SurveyPoint()
ZAxis = Vector.ZAxis()
projectRotation = Coordinates.ProjectRotation()
rotate = Geometry.Rotate(geometry=to_points, origin=surveyPoint, axis=ZAxis, degrees=projectRotation)

flatten = List.Flatten(list=rotate)
to_mm = Python(IN[0]=flatten)  # CPython3
# ---------- to_mm.python (11 lines) ----------
import clr
clr.AddReference("ProtoGeometry")
from Autodesk.DesignScript.Geometry import *

p = IN[0]
y = []

for i in p:
	y.append(Point.ByCoordinates(round(i.X*1000),round(i.Y*1000),round(i.Z*1000)))

OUT = y
# ----------------------------------------
byPoint = FamilyInstance.ByPoint(familyType=byName, point=to_mm)
code_block_5 = CodeBlock { "SiteVision Name"; }
get_name = Python(IN[0]=delete_deleted)  # CPython3
# ---------- get_name.python (1 lines) ----------
OUT = IN[0][2][1:]
# ----------------------------------------
setParameterByName = Element.SetParameterByName(element=byPoint, parameterName=code_block_5, value=get_name)
code_block_6 = CodeBlock { "SiteVision Code"; }
get_code = Python(IN[0]=delete_deleted)  # CPython3
# ---------- get_code.python (1 lines) ----------
OUT = IN[0][3][1:]
# ----------------------------------------
setParameterByName_2 = Element.SetParameterByName(element=byPoint, parameterName=code_block_6, value=get_code)
to_prepare_project_for_import_sv = CodeBlock()  # "to prepare project for import SV points"
# ---------- to_prepare_project_for_import_sv.designscript (7 lines) ----------
//get Property boundaries (from LINZ in case of New Zealand)
//unclip survey point
//"acquire coordinates" from linked DWG
//"Specify coordinates" at Survey point and assign height closer to real
//clip survey point (for safety)
//now you can run the script
//restart the scrip every time you change numbers
# ----------------------------------------
code_block_7 = CodeBlock { "SiteVision Accuracy in mm"; }
get_accuracy = Python(IN[0]=delete_deleted)  # CPython3
# ---------- get_accuracy.python (7 lines) ----------
hor_acc = IN[0][21][1:]
ver_acc = IN[0][22][1:]
summ_acc = []
for i in range(len(hor_acc)):
    summ_acc.append("H" + str(round(float(hor_acc[i])*1000)) + " V" + str(round(float(ver_acc[i])*1000)))

OUT = summ_acc
# ----------------------------------------
setParameterByName_3 = Element.SetParameterByName(element=byPoint, parameterName=code_block_7, value=get_accuracy)
code_block_8 = CodeBlock { "SiteVision Mode"; }
get_mode = Python(IN[0]=delete_deleted)  # CPython3
# ---------- get_mode.python (1 lines) ----------
OUT = IN[0][5][1:]
# ----------------------------------------
setParameterByName_4 = Element.SetParameterByName(element=byPoint, parameterName=code_block_8, value=get_mode)
split = Python(IN[0]=delete_deleted)  # CPython3; same code as get_code
uniqueItems = List.UniqueItems(list=split)
codenames = Watch(uniqueItems)
string_from_object = FromObject(object=delete_todo_s)
string_from_object_2 = FromObject(object=importCSV)
message = Python(IN[0]=string_from_object, IN[1]=string_from_object_2)  # CPython3
# ---------- message.python (21 lines) ----------
import clr

# Add references to Revit API
clr.AddReference('RevitServices')
from RevitServices.Persistence import DocumentManager

clr.AddReference('RevitAPI')
from Autodesk.Revit.DB import *

clr.AddReference('RevitAPIUI')
from Autodesk.Revit.UI import TaskDialog

# Get the current Revit document
doc = DocumentManager.Instance.CurrentDBDocument

# Define the error message and title
error_title = "Error"
error_message = "Imported CSV is in wrong format"
if IN[1] != "null":
    if IN[0] == "null":
        TaskDialog.Show(error_title, error_message)
# ----------------------------------------
message_2 = Python(IN[0]=code_block, IN[1]=code_block_2, IN[2]=code_block_3)  # CPython3
# ---------- message_2.python (21 lines) ----------
import clr

# Add references to Revit API
clr.AddReference('RevitServices')
from RevitServices.Persistence import DocumentManager

clr.AddReference('RevitAPI')
from Autodesk.Revit.DB import *

clr.AddReference('RevitAPIUI')
from Autodesk.Revit.UI import TaskDialog

# Get the current Revit document
doc = DocumentManager.Instance.CurrentDBDocument

# Define the error message and title
error_title = "Error"
error_message = "Survey point is 0,0,0. Change it to grid coordinates."

if IN[0]<1 and IN[1]<1:
    TaskDialog.Show(error_title, error_message)
# ----------------------------------------
