# Dynamo graph View_last_on_Sheet_script.dyn "View_last_on_Sheet" (Dynamo 2.16.1.2727)

active_view = Python()  # CPython3; unwired: IN[0]
# ---------- active_view.python (14 lines) ----------
import clr

clr.AddReference("RevitServices")
import RevitServices
from RevitServices.Persistence import DocumentManager
from RevitServices.Transactions import TransactionManager
doc =  DocumentManager.Instance.CurrentDBDocument
app = DocumentManager.Instance.CurrentUIApplication.Application

clr.AddReference("RevitAPI")
from Autodesk.Revit.DB import *

View = doc.ActiveView
OUT = View
# ----------------------------------------
code_block = CodeBlock { "Views"; }
byName = Category.ByName(name=code_block)
all_elements_of_category = ElementsOfCategory(Category=byName)
input_check = Python(IN[0]=all_elements_of_category)  # CPython3
# ---------- input_check.python (8 lines) ----------
input = IN[0]
elements = []

if isinstance(input, list): 
	for i in input:	elements.append(i)
else: elements = [input]
		
OUT = elements
# ----------------------------------------
string_from_object = FromObject(obj=input_check)
null_check = Python(IN[0]=string_from_object, IN[1]=input_check)  # CPython3
# ---------- null_check.python (12 lines) ----------
strings = IN[0]
list = IN[1]

elements = []


for a,b in zip(strings, list):	
	if a != "null":
		elements.append(b)

		
OUT = elements
# ----------------------------------------
template_check = Python(IN[0]=null_check)  # CPython3
# ---------- template_check.python (12 lines) ----------
# Load the Python Standard and DesignScript Libraries
#import sys
#import clr
#clr.AddReference("RevitAPI")


xz = []
for i in IN[0]:
	if UnwrapElement(i).IsTemplate==False:
		xz.append(i)

OUT =xz 
# ----------------------------------------

# group: Legend check
string_from_object_2 = FromObject(object=template_check)
code_block_2 = CodeBlock { "Legend(Name"; }
contains = String.Contains(string=string_from_object_2, searchFor=code_block_2)
filterByBoolMask = List.FilterByBoolMask(list=template_check, mask=contains)

get_last_not_on_sheet = Python(IN[0]=filterByBoolMask.out)  # CPython3
# ---------- get_last_not_on_sheet.python (17 lines) ----------
# Load the Python Standard and DesignScript Libraries
import sys
import clr
clr.AddReference("RevitAPI")
from Autodesk.Revit.DB import *


t = []
for i in IN[0]:
    if not UnwrapElement(i).GetParameters("Sheet Name"):
        t.append(UnwrapElement(i))
d = []
for i in t:
    if isinstance(i, list):
        d.append(i[0])
    else: d.append(i)
OUT = d
# ----------------------------------------
watch = Watch(get_last_not_on_sheet)
reverse = List.Reverse(list=watch)
flatten = Python(IN[0]=reverse)  # CPython3
# ---------- flatten.python (6 lines) ----------
try:
    if isinstance(IN[0], list):
        t = IN[0][0]
    else: t = IN[0]
except: t =[]
OUT = t
# ----------------------------------------
active_view_central_point = Python()  # CPython3; unwired: IN[0]
# ---------- active_view_central_point.python (49 lines) ----------
import sys
import clr
clr.AddReference('ProtoGeometry')
from Autodesk.DesignScript.Geometry import *
clr.AddReference("RevitServices")
import RevitServices
from RevitServices.Persistence import DocumentManager
from RevitServices.Transactions import TransactionManager


clr.AddReference('RevitAPI')
from Autodesk.Revit.DB import *
from Autodesk.Revit.DB import Transaction

doc = DocumentManager.Instance.CurrentDBDocument
uidoc=DocumentManager.Instance.CurrentUIApplication.ActiveUIDocument


x = uidoc.GetOpenUIViews()
z = []
for i in x: z.append(i.ViewId)
h = doc.ActiveView.Id


ff = 231



test = []
for i in z:
	if h == i: test.append("True")
	else: test.append("False")

for i in x:
	test.append(i.GetZoomCorners())

zz = list(zip(z,test,x))

res = []
for i in range(0,len(zz)):
	if zz[i][1] == "True": res.append(zz[i][2])
	

z = res[0].GetZoomCorners()

point = (z[0][0]+z[1][0])/2, (z[0][1]+z[1][1])/2


OUT = point
# ----------------------------------------
code_block_3 = CodeBlock { 304.8; }
to_mm = active_view_central_point * code_block_3
firstItem = List.FirstItem(list=to_mm)
lastItem = List.LastItem(list=to_mm)
code_block_4 = CodeBlock { 0; }
sub = lastItem - code_block_4
code_block_5 = CodeBlock { 0; }
byCoordinates = Point.ByCoordinates(x=firstItem, y=sub, z=code_block_5)
place_views_on_sheet_py = Python(IN[0]=active_view, IN[1]=flatten, IN[2]=byCoordinates)  # CPython3
# ---------- place_views_on_sheet_py.python (37 lines) ----------
################### Import References ###################
import clr

clr.AddReference("RevitServices")
import RevitServices
from RevitServices.Persistence import DocumentManager
from RevitServices.Transactions import TransactionManager
doc =  DocumentManager.Instance.CurrentDBDocument
app = DocumentManager.Instance.CurrentUIApplication.Application

clr.AddReference("RevitNodes")
import Revit
clr.ImportExtensions(Revit.Elements)
clr.ImportExtensions(Revit.GeometryConversion)

clr.AddReference("RevitAPI")
from Autodesk.Revit.DB import *
################### Definitions ###################
try: #catch when it's view selected, not sheet
    if IN[1] and IN[0]:
        ################### Outputs ###################
        sht = UnwrapElement(IN[0])
        v = UnwrapElement(IN[1])
        l = UnwrapElement(IN[2])
        ################### Script ###################
        
        
        
        TransactionManager.Instance.EnsureInTransaction(doc)
        vp = Viewport.Create(doc,sht.Id,v.Id,l.ToXyz())
        	
        	
        OUT = v
except:
    clr.AddReference('RevitAPIUI')
    from Autodesk.Revit.UI import TaskDialog
    TaskDialog.Show("Dynamo Player", "Open the required sheet, you're on a view now")
# ----------------------------------------
reverse_2 = List.Reverse(list=filterByBoolMask.out)
watch_2 = Watch(reverse_2)
if_error_pop_up_message = Python(IN[0]=flatten)  # CPython3
# ---------- if_error_pop_up_message.python (14 lines) ----------
#This script pops up a dialog box with a message from the previous node.
import clr
clr.AddReference('RevitAPIUI')



mainText = IN[0]


if not mainText: 
	from Autodesk.Revit.UI import TaskDialog
	TaskDialog.Show("Dynamo Player", "no views found")

OUT = "Success!"
# ----------------------------------------
