# Dynamo graph View_last_template_script.dyn "View_last_template" (Dynamo 2.16.1.2727)

current = Document.Current()
activeView = Document.ActiveView(document=current)
selected_elements = Python()  # CPython3; unwired: IN[0]
# ---------- selected_elements.python (41 lines) ----------
import clr

clr.AddReference('RevitAPI')
import Autodesk
from Autodesk.Revit.DB import *

clr.AddReference('RevitServices')
import RevitServices
from RevitServices.Persistence import DocumentManager

doc = DocumentManager.Instance.CurrentDBDocument
uiapp = DocumentManager.Instance.CurrentUIApplication
app = uiapp.Application
uidoc = uiapp.ActiveUIDocument

clr.AddReference('RevitNodes')
import Revit
clr.ImportExtensions(Revit.Elements)

ueWrapper = None
wrappers = clr.GetClrType(Revit.Elements.ElementWrapper).GetMethods()
for w in wrappers:
	if w.ToString().startswith("Revit.Elements.UnknownElement"):
		ueWrapper = w
		break
		
out = []
selectElemId = uidoc.Selection.GetElementIds()
selectElem = [doc.GetElement(xId) for xId in selectElemId]

for i in selectElem:
	try:
		check = Revit.Elements.ElementWrapper.Wrap(i, True)
	except: check = None

	if check is None:
		out.append(ueWrapper.Invoke(None, (i, False)))
	else:
		out.append(i) 

OUT = out
# ----------------------------------------
if_selector = Python(IN[0]=activeView, IN[1]=selected_elements)  # CPython3
# ---------- if_selector.python (3 lines) ----------
if IN[1]:
    OUT = IN[1]
else: OUT = IN[0]
# ----------------------------------------
string = StringInput("View Template")
code_block = CodeBlock { "Views"; }
byName = Category.ByName(name=code_block)
all_elements_of_category = ElementsOfCategory(Category=byName)
view_template = Python(IN[0]=all_elements_of_category)  # CPython3
# ---------- view_template.python (15 lines) ----------
import clr
clr.AddReference('RevitAPI')
from Autodesk.Revit.DB import *

def GetViewTemplate(view):
	if not view: return None
	elif hasattr(view, "ViewTemplateId"):
		if view.ViewTemplateId.IntegerValue == -1: return None
		else: return view.Document.GetElement(view.ViewTemplateId)
	else: return None

views = UnwrapElement(IN[0])

if isinstance(IN[0], list): OUT = [GetViewTemplate(x) for x in views]
else: OUT = GetViewTemplate(views)
# ----------------------------------------
string_from_object = FromObject(obj=view_template)
string_2 = StringInput("null")
contains = String.Contains(string=string_from_object, searchFor=string_2)
filterByBoolMask = List.FilterByBoolMask(list=view_template, mask=contains)
lastItem = List.LastItem(list=filterByBoolMask.out)
watch = Watch(lastItem)
setParameterByName = Element.SetParameterByName(element=if_selector, parameterName=string, value=watch)
