# Dynamo graph Template_Remove_script.dyn "Template_Remove" (Dynamo 2.16.1.2727)

current = Document.Current()
activeView = Document.ActiveView(document=current)
selected_elements = Python()  # CPython3; unwired: IN[0]
# ---------- selected_elements.python (41 lines) ----------
import clr

clr.AddReference('RevitAPI')
import Autodesk
from Autodesk.Revit.DB import *

clr.AddReference('RevitServices')
import RevitServices
from RevitServices.Persistence import DocumentManager

doc = DocumentManager.Instance.CurrentDBDocument
uiapp = DocumentManager.Instance.CurrentUIApplication
app = uiapp.Application
uidoc = uiapp.ActiveUIDocument

clr.AddReference('RevitNodes')
import Revit
clr.ImportExtensions(Revit.Elements)

ueWrapper = None
wrappers = clr.GetClrType(Revit.Elements.ElementWrapper).GetMethods()
for w in wrappers:
	if w.ToString().startswith("Revit.Elements.UnknownElement"):
		ueWrapper = w
		break
		
out = []
selectElemId = uidoc.Selection.GetElementIds()
selectElem = [doc.GetElement(xId) for xId in selectElemId]

for i in selectElem:
	try:
		check = Revit.Elements.ElementWrapper.Wrap(i, True)
	except: check = None

	if check is None:
		out.append(ueWrapper.Invoke(None, (i, False)))
	else:
		out.append(i) 

OUT = out
# ----------------------------------------
watch = Watch(selected_elements)
get_views = Python(IN[0]=watch)  # CPython3
# ---------- get_views.python (22 lines) ----------
import clr
clr.AddReference('RevitAPI')
from Autodesk.Revit.DB import *




views=UnwrapElement(IN[0])
elementlist=list()



if isinstance(IN[0], list):
	for view in views:
			elementlist.append(view.ViewId)
else: 
	elementlist.append(views.ViewId)




OUT = elementlist
# ----------------------------------------
element_by_id = ElementById(Id=get_views)
if_selector = Python(IN[0]=activeView, IN[1]=selected_elements, IN[2]=element_by_id)  # CPython3
# ---------- if_selector.python (3 lines) ----------
if IN[1]:
    OUT = IN[2]
else: OUT = IN[0]
# ----------------------------------------
watch_2 = Watch(if_selector)
python_script = Python(IN[0]=watch_2)  # CPython3
# ---------- python_script.python (31 lines) ----------
import clr
clr.AddReference('RevitAPI')
from Autodesk.Revit.DB import *

clr.AddReference('RevitServices')
import RevitServices
from RevitServices.Persistence import DocumentManager
from RevitServices.Transactions import TransactionManager


views=UnwrapElement(IN[0])
elementlist=list()

# Start Transaction
doc = DocumentManager.Instance.CurrentDBDocument
TransactionManager.Instance.EnsureInTransaction(doc)

try:
    if isinstance(IN[0], list):
    	for view in views:
    			view.ViewTemplateId = ElementId.InvalidElementId
    			elementlist.append(view.ViewTemplateId)
    else: 
    	views.ViewTemplateId = ElementId.InvalidElementId
    	elementlist.append(views.ViewTemplateId)
    
    TransactionManager.Instance.TransactionTaskDone()
    
    
    OUT = elementlist
except: OUT = "error"
# ----------------------------------------
