# Dynamo graph View_Open1_script.dyn "View_Open1" (Dynamo 2.17.0.3472)
# author: daniil.timin@gmail.com

get_all_views = Python()  # CPython3; unwired: IN[0]
# ---------- get_all_views.python (43 lines) ----------
#Copyright(c) 2019, Aaron Rumple, AIA

import clr
import System
clr.AddReference('ProtoGeometry')
from Autodesk.DesignScript.Geometry import *

# Import ToDSType(bool) extension method
clr.AddReference("RevitNodes")
import Revit
clr.ImportExtensions(Revit.Elements)

# Import DocumentManager and TransactionManager
clr.AddReference("RevitServices")
import RevitServices
from RevitServices.Persistence import DocumentManager
from RevitServices.Transactions import TransactionManager

#from System.Collections.Generic import *

# Import RevitAPI
clr.AddReference("RevitAPI")
import Autodesk
from Autodesk.Revit.DB import *

from Revit.Elements import *

doc = DocumentManager.Instance.CurrentDBDocument

def getViews(inViews):
	myViewsList = []
	for v in inViews:
		if v.IsTemplate:
			isTemplate = True
		else:
			isTemplate = False
		myViewsList.append(v.ToDSType(True))
	return myViewsList

allViews = FilteredElementCollector(doc).OfClass(View)
allViewsList = getViews(allViews)

OUT = allViewsList
# ----------------------------------------
string_from_object = FromObject(obj=get_all_views)
view_unique_word_2 = StringInput("USER ATTENTION")  # graph input
contains = String.Contains(string=string_from_object, searchFor=view_unique_word_2)
filterByBoolMask = List.FilterByBoolMask(list=get_all_views, mask=contains)
string_from_object_2 = FromObject(obj=get_all_views)
view_unique_word_1 = StringInput("_DETAILS LIBRARY")  # graph input
contains_2 = String.Contains(string=string_from_object_2, searchFor=view_unique_word_1)
filterByBoolMask_2 = List.FilterByBoolMask(list=get_all_views, mask=contains_2)
python_script = Python(IN[0]=filterByBoolMask.in, IN[1]=filterByBoolMask_2.in)  # CPython3
# ---------- python_script.python (5 lines) ----------
if IN[1] == []:
	OUT = IN[0]
	
	
else: OUT = IN[1]
# ----------------------------------------
setIntersection = List.SetIntersection(list1=python_script, list2=get_all_views)
thomasmahon_epic_script = Python(IN[0]=setIntersection)  # CPython3
# ---------- thomasmahon_epic_script.python (28 lines) ----------
#Copyright 2016. All rights reserved. Bimorph Consultancy LTD, 5 St Johns Lane, London EC1M 4BH www.bimorph.co.uk
#Written by Thomas Mahon @Thomas__Mahon info@bimorph.co.uk Package: bimorphNodes
#GitHub: https://github.com/ThomasMahon/bimorphNodes/
#Follow: facebook.com/bimorphBIM | linkedin.com/company/bimorph-bim | @bimorphBIM

import clr

clr.AddReference("RevitServices")
import RevitServices
from RevitServices.Persistence import DocumentManager
from RevitServices.Transactions import TransactionManager

clr.AddReference("RevitAPI")
import Autodesk
from Autodesk.Revit.DB import *

doc = DocumentManager.Instance.CurrentDBDocument
uidoc = DocumentManager.Instance.CurrentUIDocument

TransactionManager.Instance.EnsureInTransaction(doc)
TransactionManager.Instance.ForceCloseTransaction()
try:
    view = UnwrapElement(IN[0][0])
    uidoc.RequestViewChange( view )
except:
    clr.AddReference('RevitAPIUI')
    from Autodesk.Revit.UI import TaskDialog
    TaskDialog.Show("Dynamo Player", "Can't find the view with unique words 1 or 2 specified in the name")
# ----------------------------------------
